# Grasshopper definition Funcao_objetivo_surface.gh (Grasshopper 1.0.7)

number_slider = Slider(100, range=2..2000)
negative = Negative(Value=number_slider)
multiplication = Multiplication(A=number_slider, B=Slider(3, range=2..10))
construct_domain = ConstructDomain(DomainStart=negative, DomainEnd=number_slider)
range = Range(Domain=construct_domain, Steps=multiplication)
evaluate = Evaluate(
    Expression=" A*X^2 + B*X + C",
    X=range,
    A=Slider(2, range=-10..10),
    B=Slider(6, range=-10..10),
    C=Slider(-5, range=-10..10))
subtraction = Subtraction(A=evaluate, B=Slider(10, range=0..100))
construct_point = ConstructPoint(XCoordinate=range, YCoordinate=evaluate, ZCoordinate=0)
absolute = Absolute(Value=subtraction)
polyline = PolyLine(Vertices=construct_point, Closed=False)
construct_point_2 = ConstructPoint(XCoordinate=range, YCoordinate=absolute, ZCoordinate=0)
polyline_2 = PolyLine(Vertices=construct_point_2, Closed=False)
