# Grasshopper definition Funcao_objetivo_v2.gh (Grasshopper 1.0.7)

number_slider = Slider(228, range=2..2000)
negative = Negative(Value=number_slider)
multiplication = Multiplication(A=number_slider, B=Slider(35, range=2..100))
construct_domain = ConstructDomain(DomainStart=negative, DomainEnd=number_slider)
number_slider_2 = Slider(6, range=-100..100)
range = Range(Domain=construct_domain, Steps=multiplication)
evaluate = Evaluate(
    Expression=" A*X^2 + B*X + C",
    X=range,
    A=Slider(6, range=-100..100),
    B=Slider(6, range=-100..100),
    C=Slider(6, range=-100..100))
construct_point = ConstructPoint(XCoordinate=range, YCoordinate=evaluate, ZCoordinate=0)
subtraction = Subtraction(A=evaluate, B=Slider(22, range=0..100))
absolute = Absolute(Value=subtraction)
polyline = PolyLine(Vertices=construct_point, Closed=False)
construct_point_2 = ConstructPoint(XCoordinate=range, YCoordinate=absolute, ZCoordinate=0)
polyline_2 = PolyLine(Vertices=construct_point_2, Closed=False)  # -> reverse(Polyline)
