# Grasshopper definition Função objetivo.gh (Grasshopper 1.0.7)

number_slider = Slider(0.01, range=0..1)
number_slider_2 = Slider(500, range=2..2000)
negative = Negative(Value=number_slider)
series = Series(Start="0", Step=negative, Count=number_slider_2)
series_2 = Series(Start="0", Step=number_slider, Count=number_slider_2)
merge = Merge(Data1=series, Data2=series_2)
evaluate = Evaluate(
    Expression=" A*X^2 + B*X + C",
    X=merge,
    A=Slider(1, range=-10..10),
    B=Slider(0, range=-10..10),
    C=Slider(-5, range=-10..10))
subtraction = Subtraction(A=evaluate, B=Slider(10, range=0..100))
absolute = Absolute(Value=subtraction)
construct_point = ConstructPoint(XCoordinate=merge, YCoordinate=evaluate, ZCoordinate=0)
construct_point_2 = ConstructPoint(XCoordinate=merge, YCoordinate=absolute, ZCoordinate=0)
