# Grasshopper definition Universal_thermal_climate_index.gh (Grasshopper 1.0.7)

ladybug = Ladybug_Ladybug()  # -> out; plug-in component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
panel = Panel(ladybug)
outdoorcomfortcalculator = Ladybug_OutdoorComfortCalculator(dryBulbTemperature=Slider(10, range=10..50), relativeHumidity=Slider(10, range=10..90), runIt=Toggle(True))  # -> out, port, universalThermalClimateIndex, comfortableOrNot, thermalStress, conditionOfPerson, port_2, percentOfTimeComfortable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; plug-in component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
panel_2 = Panel(outdoorcomfortcalculator.out)
comfortmannequin = Ladybug_ComfortMannequin(ambientTemperature=outdoorcomfortcalculator.universalThermalClimateIndex)  # -> mannequinMesh, legend, legendBasePt; plug-in component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
