# Grasshopper definition Universal_thermal_climate_index_legend_param.gh (Grasshopper 1.0.7)

ladybug = Ladybug_Ladybug()  # -> out; plug-in component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
northarrow = Ladybug_North()  # -> northSign; plug-in component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
panel = Panel(ladybug)
gradientlibrary = Ladybug_GradientLibrary(gradIndex=Slider(0, range=0..23))  # -> customColors; plug-in component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
panel_2 = Panel(gradientlibrary)
outdoorcomfortcalculator = Ladybug_OutdoorComfortCalculator(
    dryBulbTemperature=Slider(10, range=10..50),
    windSpeed_tenMeters=Slider(5, range=5..100),
    relativeHumidity=Slider(10, range=10..90),
    runIt=Toggle(True))  # -> out, port, universalThermalClimateIndex, comfortableOrNot, thermalStress, conditionOfPerson, port_2, percentOfTimeComfortable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; plug-in component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
legendpar = Ladybug_LegendParameters(
    lowBound=Slider(12, range=0..100),
    highBound=Slider(70, range=0..100),
    numSegments=Slider(14, range=5..22),
    customColors=flatten(gradientlibrary),
    legendScale=Slider(0.75, range=0.01..3),
    decimalPlaces=Slider(1, range=0..4))  # -> legendPar; plug-in component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
panel_3 = Panel(outdoorcomfortcalculator.out)
comfortmannequin = Ladybug_ComfortMannequin(
    ambientTemperature=outdoorcomfortcalculator.universalThermalClimateIndex,
    bodyPosture=Slider(2, range=0..2),
    legendPar=legendpar,
    bakeIt=Toggle(False))  # -> mannequinMesh, legend, legendBasePt; plug-in component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
