# Grasshopper definition install_check.gh (Grasshopper 1.0.7)

versions = HBCheckVersions()  # -> python, radiance, openstudio, energyplus; plug-in component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
panel = Panel(versions.python)
panel_2 = Panel(versions.openstudio)
panel_3 = Panel(versions.radiance)
panel_4 = Panel(versions.energyplus)
config = HBConfig()  # -> python_exe, py_lib_install, rad_install, os_install, ep_install, hb_os_gem, standards, asset_report, default_sim; plug-in component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
panel_5 = Panel(config.python_exe)
panel_6 = Panel(config.py_lib_install)
panel_7 = Panel(config.rad_install)
panel_8 = Panel(config.os_install)
panel_9 = Panel(config.ep_install)
panel_10 = Panel(config.hb_os_gem)
panel_11 = Panel(config.standards)
panel_12 = Panel(config.default_sim)
panel_13 = Panel(config.asset_report)
