# Grasshopper definition ponto_de_orvalho.gh (Grasshopper 1.0.7)

construct_domain = ConstructDomain(DomainStart="5", DomainEnd="100")
construct_domain_2 = ConstructDomain(DomainStart="-10", DomainEnd="90")
range = Range(Domain=construct_domain, Steps="20")
range_2 = Range(Domain=construct_domain_2, Steps="20")
ladybug = Ladybug_Ladybug()  # -> out; plug-in component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
calchumidityratio = Ladybug_HumidityRatioCalculator()  # -> out, humidityRatio, enthalpy, partialPressure, saturationPressure; plug-in component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
cross_reference = CrossReference(ListA=range_2, ListB=range, CrossMode=1)  # -> ListA, ListB
panel = Panel(ladybug)
wetbulbtemp_dewpointtemp = Ladybug_WetBulbTemp(dryBulbTemperature=cross_reference.ListA, relativeHumidity=cross_reference.ListB)  # -> out, wetBulbTemp, dewPointTemp; plug-in component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
construct_point = ConstructPoint(XCoordinate=cross_reference.ListA, YCoordinate=cross_reference.ListB, ZCoordinate=wetbulbtemp_dewpointtemp.dewPointTemp)
