# Grasshopper definition teste_ladybug_01.gh (Grasshopper 1.0.7)

panel = Panel("https://www.energyplus.net/weather-download/south_america_wmo_region_3/BRA//BRA_Salvador.832290_SWERA/all")
# Rosa dos ventos
# Gráfico de temperatura
ladybug = Ladybug_Ladybug()  # -> out; plug-in component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
panel_2 = Panel(ladybug)
downloadepw = Ladybug_downloadEPWWeatherFile(download=Toggle(False))  # -> Output; plug-in component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
epw_stat = Ladybug_OpenEPWAndSTATWeatherFiles(weatherFileURL=panel)  # -> epwFile, statFile; plug-in component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
panel_3 = Panel(downloadepw)
importepw = Ladybug_ImportEpw(epwFile=epw_stat.epwFile)  # -> Output, latitude, location, dryBulbTemperature, dewPointTemperature, relativeHumidity, windSpeed, windDirection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; plug-in component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
panel_4 = Panel(importepw.modelYear)
legendpar = Ladybug_LegendParameters()  # -> legendPar; plug-in component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
panel_5 = Panel("b > 20")
panel_6 = Panel("a < 25")
point = Point(Point(-89, 798, 0))
windrose = Ladybug_WindRose(
    north=0,
    hourlyWindDirection=importepw.windDirection,
    hourlyWindSpeed=importepw.windSpeed,
    annualHourlyData=flatten(importepw.dryBulbTemperature),
    runIt=Toggle(True))  # -> out, calmRoseMesh, windRoseMesh, windRoseCrvs, windRoseCenPts, legend, legendBasePts, title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; plug-in component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
_3dchart = Ladybug_3DChart(
    inputData=flatten(importepw.dryBulbTemperature),
    basePoint=point,
    xScale="0.25",
    zScale=Slider(0, range=0..1),
    legendPar=legendpar)  # -> out, graphMesh, graphCurves, legend, legendBasePts, title, titleBasePts, dataPts, conditionalHOY; plug-in component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
