# Grasshopper definition avaliando_epw.gh (Grasshopper 1.0.7)

ladybug = Ladybug_Ladybug()  # -> out; plug-in component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
panel = Panel("https://www.energyplus.net/weather-download/south_america_wmo_region_3/BRA//BRA_Salvador.832290_SWERA/all")
downloadepw = Ladybug_downloadEPWWeatherFile(download=Toggle(False))  # -> Output; plug-in component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
panel_2 = Panel(ladybug)
panel_3 = Panel(downloadepw)
epw_stat = Ladybug_OpenEPWAndSTATWeatherFiles(weatherFileURL=panel)  # -> epwFile, statFile; plug-in component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
importepw = Ladybug_ImportEpw(epwFile=epw_stat.epwFile)  # -> Output, latitude, location, dryBulbTemperature, dewPointTemperature, relativeHumidity, windSpeed, windDirection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; plug-in component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
gradientlibrary = Ladybug_GradientLibrary(gradIndex=Slider(0, range=0..23))  # -> customColors; plug-in component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
legendpar = Ladybug_LegendParameters(customColors=flatten(gradientlibrary))  # -> legendPar; plug-in component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
panel_4 = Panel(importepw.modelYear)
explodelocation = Ladybug_DecomposeLocation(location=importepw.location)  # -> locationName, latitude, longitude, timeZone, elevation; plug-in component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
strnum = Ladybug_SeparateData(inputList=flatten(importepw.modelYear))  # -> numbers, strings; plug-in component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
panel_5 = Panel(explodelocation.elevation)
create_set = CreateSet(List=strnum.numbers)  # -> Set, Map
_3dchart = Ladybug_3DChart(inputData=flatten(importepw.dryBulbTemperature), xScale="0.25", zScale="0", legendPar=legendpar)  # -> out, graphMesh, graphCurves, legend, legendBasePts, title, titleBasePts, dataPts, conditionalHOY; plug-in component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
panel_6 = Panel(create_set.Set)
sort_list = SortList(Keys=create_set.Set)  # -> Keys, ValuesA
panel_7 = Panel(sort_list.Keys)
