# Grasshopper definition exemplo_edf.gh (Grasshopper 1.0.7)

number_slider = Slider(13, range=0..50)
number_slider_2 = Slider(14, range=0..50)
negative = Negative(Value=number_slider)
division = Division(A=number_slider, B=2)
negative_2 = Negative(Value=number_slider_2)
division_2 = Division(A=number_slider_2, B=2)
point = Point(<point referenced from the Rhino model>)
unit_z = UnitZ(Factor=Slider(13, range=0..50))
construct_domain = ConstructDomain(DomainStart=negative, DomainEnd=division)
xy_plane = XYPlane(Origin=point)
construct_domain_2 = ConstructDomain(DomainStart=negative_2, DomainEnd=division_2)
rotate_plane = RotatePlane(Plane=xy_plane, Angle=Slider(49, range=0..360))
rectangle = Rectangle(Plane=rotate_plane, XSize=construct_domain_2, YSize=construct_domain, Radius=0)  # -> Rectangle, Length
extrude = Extrude(Base=rectangle.Rectangle, Direction=unit_z)
cap_holes = CapHoles(Brep=extrude)
