# Grasshopper definition gallapagos_teste_01.gh (Grasshopper 1.0.7)

rotz = Slider(0, range=0..360)
rotx = Slider(168.08, range=0..360)
roty = Slider(160.8, range=0..360)
brep = Brep(<brep referenced from the Rhino model>)
unit_x = UnitX(Factor=1)
volume = Volume(Geometry=brep)  # -> Volume, Centroid
unit_y = UnitY(Factor=1)
rotate_3d = Rotate3D(Geometry=brep, Angle=rotx, Center=volume.Centroid, Axis=unit_x)  # -> Geometry, Transform
unit_z = UnitZ(Factor=1)
rotate_3d_2 = Rotate3D(Geometry=rotate_3d.Geometry, Angle=roty, Center=volume.Centroid, Axis=unit_y)  # -> Geometry, Transform
rotate_3d_3 = Rotate3D(Geometry=rotate_3d_2.Geometry, Angle=rotz, Center=volume.Centroid, Axis=unit_z)  # -> Geometry, Transform
box = Box(rotate_3d_3.Geometry)
volume_2 = Volume(Geometry=box)  # -> Volume, Centroid
galapagos = Galapagos(fitness=volume_2, gene=[rotx, roty, rotz])
