# Grasshopper definition ladybug_02.gh (Grasshopper 1.0.8)
# plug-ins: LadybugGrasshopper

lb_falsestart_toggle = LBFalseStartToggle(False)
panel = Panel("https://climate.onebuilding.org/WMO_Region_3_South_America/BRA_Brazil/BA_Bahia/BRA_BA_Salvador-Magalhaes.Intl.AP.832480_TMYx.zip")
# https://energyplus-weather.s3.amazonaws.com/south_america_wmo_region_3/BRA/BRA_BA_Salvador-Magalhaes.Intl.AP.832480_TRY.1961/BRA_BA_Salvador-Magalhaes.Intl.AP.832480_TRY.1961.zip
panel_2 = Panel("https://climate.onebuilding.org/WMO_Region_3_South_America/BRA_Brazil/BA_Bahia/BRA_BA_Salvador.866780_TMYx.zip")
epwmap = LBEPWmap(epw_map=lb_falsestart_toggle)  # -> report; plug-in component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
downloadepw = LBDownloadWeather(weather_URL=panel)  # -> epw_file, stat_file, ddy_file; plug-in component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
downloadepw_2 = LBDownloadWeather(weather_URL=panel_2)  # -> epw_file, stat_file, ddy_file; plug-in component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
panel_3 = Panel(epwmap)
importepw = LBImportEPW(epw_file=downloadepw.epw_file)  # -> location, dry_bulb_temperature, dew_point_temperature, relative_humidity, wind_speed, wind_direction, direct_normal_rad, diffuse_horizontal_rad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; plug-in component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
importepw_2 = LBImportEPW(epw_file=downloadepw_2.epw_file)  # -> location, dry_bulb_temperature, dew_point_temperature, relative_humidity, wind_speed, wind_direction, direct_normal_rad, diffuse_horizontal_rad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; plug-in component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
xdata = LBDeconstructData(data=[importepw_2.dry_bulb_temperature, importepw.dry_bulb_temperature])  # -> header, flatten(values); plug-in component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
xdata_2 = LBDeconstructData(data=importepw_2.model_year)  # -> header, values; plug-in component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
sort_list = SortList(Keys=xdata.values)  # -> Keys, ValuesValuesA
create_set = CreateSet(List=xdata_2.values)  # -> Set, Map
sunpath = LBSunPath(location=importepw_2.location, scale=1)  # -> out, vectors, altitudes, azimuths, hoys, sun_pts, analemma, daily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; plug-in component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
list_item = ListItem(List=sort_list.Keys, Index=0, Wrap=True)  # -> Item1, Item
lb_falsestart_toggle_2 = LBFalseStartToggle(True)
panel_4 = Panel(create_set.Set)
legendpar = LBLegendParameters(min=list_item.Item, max=list_item.Item1)  # -> leg_par; plug-in component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
legacy = LBLegacyUpdater(update=lb_falsestart_toggle_2)  # -> out; plug-in component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
point = Point(Point(7, 141, 0))
hourlyplot = LBHourlyPlot(data=flatten(importepw_2.dry_bulb_temperature), legend_par=legendpar)  # -> report, mesh, legend, borders, labels, title, vis_set; plug-in component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
hourlyplot_2 = LBHourlyPlot(data=flatten(importepw.dry_bulb_temperature), base_pt=point, legend_par=legendpar)  # -> report, mesh, legend, borders, labels, title, vis_set; plug-in component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
