# Grasshopper definition testes_legendas_ladybug.gh (Grasshopper 1.0.7)

legendpar = Ladybug_LegendParameters(lowBound="-3", highBound="4", numSegments=Slider(18, range=0..100), decimalPlaces=Slider(0, range=0..3))  # -> legendPar; plug-in component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
ladybug = Ladybug_Ladybug()  # -> out; plug-in component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
range = Range(Domain=Domain(0, 1), Steps=10)
panel = Panel(ladybug)
createlegend = Ladybug_CreateLegend(valuesOrRange=range, legendTitle="teste de legenda", legendPar=legendpar)  # -> legendMesh, legendTextSrf, legendBasePt, port, textValuesBasePts, legendTextValues, recommendedTextSize; plug-in component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
recolormesh = Ladybug_RecolorMesh(
    analysisResult=range,
    lowBoundColor=ColourSwatch(SwatchColor=RGB(97, 224, 255)),
    highBoundColor=ColourSwatch(SwatchColor=RGB(25, 29, 255)))  # -> out, newMesh, newLegend, legendBasePt, meshColors, legendColors; plug-in component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
text_tag_3d = TextTag3D(
    Location=createlegend.textValuesBasePts,
    Text=createlegend.legendTextValues,
    Size=createlegend.recommendedTextSize,
    Colour=RGB(190, 200, 20),
    Justification=1)
