# Grasshopper definition teste_ladybug_03.gh (Grasshopper 1.0.7)

panel = Panel("https://www.energyplus.net/weather-download/south_america_wmo_region_3/BRA//BRA_Salvador.832290_SWERA/all")
ladybug = Ladybug_Ladybug()  # -> out; plug-in component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
downloadepw = Ladybug_downloadEPWWeatherFile(download=Toggle(False))  # -> Output; plug-in component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
# Radiation Rose
# Radiation Analisys
panel_2 = Panel(ladybug)
epw_stat = Ladybug_OpenEPWAndSTATWeatherFiles(weatherFileURL=panel)  # -> epwFile, statFile; plug-in component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
panel_3 = Panel(downloadepw)
gencumulativeskymtx = Ladybug_GenCumulativeSkyMtx(epwFile=epw_stat.epwFile, skyDensity=0, useOldRes=True, runIt=Toggle(True))  # -> out, cumulativeSkyMtx; plug-in component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
selectskymtx = Ladybug_selectSkyMtx(cumulativeSkyMtx=gencumulativeskymtx.cumulativeSkyMtx, removeDiffuse=False, removeDirect=False)  # -> out, selectedSkyMtx; plug-in component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
radiationrose = Ladybug_RadiationRose(selectedSkyMtx=selectskymtx.selectedSkyMtx, arrowHeadScale=1, runIt=Toggle(True))  # -> out, radiationArrowsMesh, radRoseBaseCrvs, legend, legendBasePts, radRoseEndPts, radRoseValues; plug-in component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
point = Point(Point(-1, 0, 0))
number_slider = Slider(360, range=0..1000)
number_slider_2 = Slider(10, range=0..10)
division = Division(A=number_slider, B=number_slider_2)
range = Range(Domain=number_slider, Steps=division)
orientationstudypar = Ladybug_OrientationStudyParameters(divisionAngle=number_slider_2, totalAngle=number_slider, basePoint=point, runTheStudy=Toggle(True))  # -> orientationStudyPar; plug-in component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
panel_4 = Panel(range)
brep = Brep(<brep referenced from the Rhino model>)
brep_2 = Brep([<brep referenced from the Rhino model> x3])
radiationanalysis = Ladybug_RadiationAnalysis(
    geometry=flatten(brep),
    context=flatten(brep_2),
    gridSize=Slider(3, range=0.01..10),
    disFromBase=Slider(0.25, range=0..1),
    orientationStudyP=flatten(orientationstudypar),
    selectedSkyMtx=flatten(selectskymtx.selectedSkyMtx),
    parallel=Toggle(True),
    runIt=Toggle(True))  # -> out, contextMesh, analysisMesh, testPts, testVec, port, radiationResult, radiationMesh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; plug-in component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
sort_list = SortList(Keys=radiationanalysis.totalRadiation, ValuesA=range)  # -> reverse(Keys), reverse(ValuesA)
panel_5 = Panel(sort_list.Keys)
panel_6 = Panel(sort_list.ValuesA)
panel_7 = Panel(radiationanalysis.totalRadiation)
panel_8 = Panel(radiationanalysis.radiationMesh)
list_item = ListItem(List=sort_list.Keys, Index=0, Wrap=True)
list_item_2 = ListItem(List=sort_list.ValuesA, Index=0, Wrap=True)
rotate_3d = Rotate3D(Geometry=radiationanalysis.radiationMesh, Angle=list_item_2, Center=point, Axis=Vector(0, 0, 1))  # -> Geometry, Transform
panel_9 = Panel(list_item)
panel_10 = Panel(list_item_2)
