# Grasshopper definition final.gh (Grasshopper 1.0.7)
# plug-ins: Human UI

ladybug = Ladybug_Ladybug()  # -> out; plug-in component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
panel = Panel("https://www.energyplus.net/weather-download/south_america_wmo_region_3/BRA//BRA_Salvador.832290_SWERA/all")
downloadepw = Ladybug_downloadEPWWeatherFile(download=Toggle(False))  # -> Output; plug-in component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
epw_stat = Ladybug_OpenEPWAndSTATWeatherFiles(weatherFileURL=panel)  # -> epwFile, statFile; plug-in component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
importepw = Ladybug_ImportEpw(epwFile=epw_stat.epwFile)  # -> Output, latitude, location, dryBulbTemperature, dewPointTemperature, relativeHumidity, windSpeed, windDirection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; plug-in component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
explodelocation = Ladybug_DecomposeLocation(location=importepw.location)  # -> locationName, latitude, longitude, timeZone, elevation; plug-in component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
strnum = Ladybug_SeparateData(inputList=flatten(importepw.relativeHumidity))  # -> numbers, strings; plug-in component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
strnum_2 = Ladybug_SeparateData(inputList=flatten(importepw.windSpeed))  # -> numbers, strings; plug-in component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
strnum_3 = Ladybug_SeparateData(inputList=flatten(importepw.dryBulbTemperature))  # -> numbers, strings; plug-in component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
legendpar = Ladybug_LegendParameters()  # -> legendPar; plug-in component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
gencumulativeskymtx = Ladybug_GenCumulativeSkyMtx(epwFile=epw_stat.epwFile, skyDensity=0, useOldRes=True, runIt=Toggle(True))  # -> out, cumulativeSkyMtx; plug-in component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
number_slider = Slider(10, range=0..180)
number_slider_2 = Slider(360, range=0..360)
ghpython_script = GhPythonScript(cidade=explodelocation.locationName, dbTemp=strnum_3.numbers, umidade=strnum.numbers, velociVento=strnum_2.numbers)  # -> out, a; inputs dbTemp: list, umidade: tree, velociVento: tree
# ---------- ghpython_script: Python ----------
__author__ = "ffrib"
__version__ = "2019.07.16"

import rhinoscriptsyntax as rs
import csv

dbMax = max(dbTemp)
dbMin = min(dbTemp)
dbMed = sum(dbTemp)/len(dbTemp)
print (dbMax, dbMin, dbMed)

docPath = rs.DocumentPath() 
with open( docPath + 'Tabela.csv', mode='w') as Tabela:
    Tabela_writer = csv.writer(Tabela, delimiter=';', quotechar='"', quoting=csv.QUOTE_MINIMAL)
    #Tabela_writer.writeheader(['Cidade', 'Temp max anual', 'Temp Min Anual', 'Temp Med Anual'])
    Tabela_writer.writerow([cidade, dbMax, dbMin, dbMed])
# ---------- end ghpython_script ----------
point = Point(Point(-6.598707322, -23.73306006, 0))
division = Division(A=number_slider_2, B=number_slider)
selectskymtx = Ladybug_selectSkyMtx(cumulativeSkyMtx=gencumulativeskymtx.cumulativeSkyMtx, removeDiffuse=False, removeDirect=False)  # -> out, selectedSkyMtx; plug-in component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
range = Range(Domain=number_slider_2, Steps=division)
orientationstudypar = Ladybug_OrientationStudyParameters(divisionAngle=number_slider, totalAngle=number_slider_2, basePoint=point, runTheStudy=Toggle(True))  # -> orientationStudyPar; plug-in component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
brep = Brep([<brep referenced from the Rhino model> x3])
brep_2 = Brep(<brep referenced from the Rhino model>)
radiationanalysis = Ladybug_RadiationAnalysis(
    geometry=flatten(brep_2),
    context=flatten(brep),
    gridSize=Slider(5, range=0..10),
    disFromBase=Slider(0.1, range=0..0.1),
    orientationStudyP=flatten(orientationstudypar),
    selectedSkyMtx=flatten(selectskymtx.selectedSkyMtx),
    parallel=Toggle(True),
    runIt=Toggle(True))  # -> out, contextMesh, analysisMesh, testPts, testVec, port, radiationResult, radiationMesh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; plug-in component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
panel_2 = Panel(range)
analysisperiod = Ladybug_AnalysisPeriod(fromMonth=Slider(1, range=1..12), toMonth=Slider(3, range=1..12))  # -> out, analysisPeriod; plug-in component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
sort_list = SortList(Keys=radiationanalysis.totalRadiation, ValuesValuesA=range)  # -> Keys, ValuesValuesA
panel_3 = Panel(sort_list.ValuesValuesA)
sunpath = Ladybug_SunPath(
    location=importepw.location,
    hour=12,
    day=21,
    month=12,
    timeStep=1,
    analysisPeriod=analysisperiod.analysisPeriod,
    projection=Slider(0, range=0..2),
    legendPar=legendpar,
    dailyOrAnnualSunPath=True)  # -> out, sunVectors, sunAltitudes, sunAzimuths, port, sunSpheresMesh, sunPathCrvs, compassCrvs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; plug-in component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
panel_4 = Panel(sort_list.Keys)
panel_5 = Panel(radiationanalysis.totalRadiation)
get_screen_dimensions = GetScreenDimensions()  # -> Width, Height
division_2 = Division(A=get_screen_dimensions.Height, B=2)
create_text_box = CreateTextBox(Label="Cidade 02", UpdateButton=True, showLabel=True)
create_text_box_2 = CreateTextBox(Label="Cidade 01", UpdateButton=True, showLabel=True)
launch_window = LaunchWindow(
    Show=Toggle(False),
    Name="teste",
    Width=get_screen_dimensions.Width,
    Height=get_screen_dimensions.Height,
    ChildStatus=0,
    EnableHorizScroll=False)
create_browser = CreateBrowser(URL="https://www.ladybug.tools/epwmap/", Width=get_screen_dimensions.Width, Height=division_2)
merge = Merge(Data1=create_browser, Data2=create_text_box_2, Data3=create_text_box)
add_elements = AddElements(Window=launch_window, Elements=flatten(merge), DoVLChecking=True)  # -> AddedElements, ElementNames
set_textblock_contents = SetTextBlockContents(NewTextBlockContents=create_text_box_2)
