# Grasshopper definition func_Objetivo.gh (Grasshopper 1.0.7)

negative = Negative(Value="100")
construct_domain = ConstructDomain(DomainStart=negative, DomainEnd="100")
range = Range(Domain=construct_domain, Steps=Slider(184, range=0..300))
evaluate = Evaluate(
    Expression="a*x^2 + b*x +c",
    x=range,
    a=Slider(0.5, range=-10..10),
    b=Slider(3.65, range=-10..10),
    c=Slider(10, range=-10..10))
construct_point = ConstructPoint(XCoordinate=range, YCoordinate=evaluate, ZCoordinate=0)
panel = Panel(evaluate)
interpolate = Interpolate(Vertices=construct_point, Degree=3, Periodic=False, KnotStyle=1)  # -> Curve, Length, Domain
