# Grasshopper definition teste_ladybug_00.gh (Grasshopper 1.0.7)

ladybug = Ladybug_Ladybug()  # -> out; plug-in component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
panel = Panel(ladybug)
outdoorcomfortcalculator = Ladybug_OutdoorComfortCalculator(
    dryBulbTemperature=reverse(Slider(30, range=0..40)),
    windSpeed_tenMeters=Slider(5, range=0..5),
    relativeHumidity=Slider(49.61, range=0..100),
    runIt=Toggle(True))  # -> out, port, universalThermalClimateIndex, comfortableOrNot, thermalStress, conditionOfPerson, port_2, percentOfTimeComfortable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; plug-in component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
panel_2 = Panel(outdoorcomfortcalculator.universalThermalClimateIndex)
comfortmannequin = Ladybug_ComfortMannequin(
    ambientTemperature=outdoorcomfortcalculator.universalThermalClimateIndex,
    targetTemperature=Slider(23, range=-10..40),
    bodyPosture=Slider(2, range=0..2))  # -> mannequinMesh, legend, legendBasePt; plug-in component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
