# Grasshopper definition teste_ladybug_01.gh (Grasshopper 1.0.7)

panel = Panel("https://www.energyplus.net/weather-download/south_america_wmo_region_3/BRA//BRA_Salvador.832290_SWERA/all")
file_path = FilePath("C:\Users\ffrib\Desktop\BRA_Salvador.832290_SWERA\BRA_Salvador.832290_SWERA.epw")
ladybug = Ladybug_Ladybug()  # -> out; plug-in component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
importepw = Ladybug_ImportEpw(epwFile=file_path)  # -> Output, latitude, location, dryBulbTemperature, dewPointTemperature, relativeHumidity, windSpeed, windDirection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; plug-in component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
panel_2 = Panel(ladybug)
downloadepw = Ladybug_downloadEPWWeatherFile(download=Toggle(True))  # -> Output; plug-in component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
panel_3 = Panel(importepw.Output)
epw_stat = Ladybug_OpenEPWAndSTATWeatherFiles(weatherFileURL=panel)  # -> epwFile, statFile; plug-in component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
gencumulativeskymtx = Ladybug_GenCumulativeSkyMtx(epwFile=epw_stat.epwFile, skyDensity=0, useOldRes=True, runIt=False)  # -> out, cumulativeSkyMtx; plug-in component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
selectskymtx = Ladybug_selectSkyMtx(cumulativeSkyMtx=gencumulativeskymtx.cumulativeSkyMtx, removeDiffuse=False, removeDirect=False)  # -> out, selectedSkyMtx; plug-in component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
analysisperiod = Ladybug_AnalysisPeriod(fromMonth=Slider(11, range=0..100), toMonth=Slider(3, range=0..10))  # -> out, analysisPeriod; plug-in component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
outdoorcomfortcalculator = Ladybug_OutdoorComfortCalculator()  # -> out, port, universalThermalClimateIndex, comfortableOrNot, thermalStress, conditionOfPerson, port_2, percentOfTimeComfortable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; plug-in component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
radiationrose = Ladybug_RadiationRose(arrowHeadScale=1)  # -> out, radiationArrowsMesh, radRoseBaseCrvs, legend, legendBasePts, radRoseEndPts, radRoseValues; plug-in component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
sunpath = Ladybug_SunPath(
    location=importepw.location,
    hour=12,
    day=21,
    month=12,
    timeStep=1,
    analysisPeriod=analysisperiod.analysisPeriod,
    annualHourlyData=flatten(importepw.dryBulbTemperature),
    dailyOrAnnualSunPath=True)  # -> out, sunVectors, sunAltitudes, sunAzimuths, port, sunSpheresMesh, sunPathCrvs, compassCrvs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; plug-in component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
point = Point(Point(-1, 0, 0))
orientationstudypar = Ladybug_OrientationStudyParameters(divisionAngle=Slider(10, range=0..10), totalAngle=Slider(360, range=0..1000), basePoint=point, runTheStudy=Toggle(True))  # -> orientationStudyPar; plug-in component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
radiationanalysis = Ladybug_RadiationAnalysis(orientationStudyP=flatten(orientationstudypar))  # -> out, contextMesh, analysisMesh, testPts, testVec, port, radiationResult, radiationMesh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; plug-in component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
