# Grasshopper definition HONEYBEE_EXAMPLE_FINAL.gh (Grasshopper 1.0.8)
# plug-ins: LadybugGrasshopper

# ---- group: VETOR PARA CORREÇÃO DA POSIÇÃO DAS PORTAS
unit_z = UnitZ(Factor=Slider(0.001, range=0..1))

# ----
brep = Brep(<brep referenced from the Rhino model>)
brep_2 = Brep(<brep referenced from the Rhino model>)
brep_3 = Brep(<brep referenced from the Rhino model>)

brep_4 = Brep(<brep referenced from the Rhino model>)
brep_5 = Brep(<brep referenced from the Rhino model>)
brep_6 = Brep([<brep referenced from the Rhino model> x2])

brep_7 = Brep(<brep referenced from the Rhino model>)
brep_8 = Brep(<brep referenced from the Rhino model>)
brep_9 = Brep(<brep referenced from the Rhino model>)

brep_10 = Brep(<brep referenced from the Rhino model>)
brep_11 = Brep(<brep referenced from the Rhino model>)
brep_12 = Brep(<brep referenced from the Rhino model>)

move = Move(Geometry=brep_3, Motion=unit_z)  # -> Geometry, Transform
move_2 = Move(Geometry=brep_6, Motion=unit_z)  # -> Geometry, Transform
move_3 = Move(Geometry=brep_9, Motion=unit_z)  # -> Geometry, Transform
move_4 = Move(Geometry=brep_12, Motion=unit_z)  # -> Geometry, Transform

# ---- group: TRANSFORMANDO AS GEOMETRIAS DO RHINO EM OBJETOS DO HB
concatenate = Concatenate(FragmentA="Porta", FragmentB="Quarto")
concatenate_2 = Concatenate(FragmentA="Janela", FragmentB="Quarto")
concatenate_3 = Concatenate(FragmentA="Porta", FragmentB="Cozinha")
concatenate_4 = Concatenate(FragmentA="Janela", FragmentB="Cozinha")
concatenate_5 = Concatenate(FragmentA="Porta", FragmentB="Banheiro")
concatenate_6 = Concatenate(FragmentA="Janela", FragmentB="Banheiro")
concatenate_7 = Concatenate(FragmentA="Porta", FragmentB="Sala")
concatenate_8 = Concatenate(FragmentA="Janela", FragmentB="Sala")
aperture = HBAperture(geo=brep_2, name=concatenate_2)  # -> out, apertures; plug-in component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
roomsolid = HBRoomFromSolid(geo=flatten(brep), name="Quarto", conditioned=Toggle(True))  # -> out, rooms; plug-in component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
door = HBDoor(geo=move.Geometry, name=concatenate)  # -> out, doors; plug-in component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
roomsolid_2 = HBRoomFromSolid(geo=flatten(brep_10), name="Sala", conditioned=Toggle(True))  # -> out, rooms; plug-in component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
aperture_2 = HBAperture(geo=brep_5, name=concatenate_4)  # -> out, apertures; plug-in component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
roomsolid_3 = HBRoomFromSolid(geo=flatten(brep_4), name="Cozinha", conditioned=Toggle(False))  # -> out, rooms; plug-in component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
aperture_3 = HBAperture(geo=brep_11, name=concatenate_8)  # -> out, apertures; plug-in component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
door_2 = HBDoor(geo=move_2.Geometry, name=concatenate_3)  # -> out, doors; plug-in component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
door_3 = HBDoor(geo=move_4.Geometry, name=concatenate_7)  # -> out, doors; plug-in component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
aperture_4 = HBAperture(geo=brep_8, name=concatenate_6)  # -> out, apertures; plug-in component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
roomsolid_4 = HBRoomFromSolid(geo=flatten(brep_7), name="Banheiro", conditioned=Toggle(False))  # -> out, rooms; plug-in component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
door_4 = HBDoor(geo=move_3.Geometry, name=concatenate_5)  # -> out, doors; plug-in component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

# ---- group: JUNTANDO GEOMETRIAS PARA O MODELO
merge = Merge(Data1=roomsolid_2.rooms, Data2=roomsolid.rooms, Data3=roomsolid_3.rooms, Data4=roomsolid_4.rooms)
merge_2 = Merge(Data1=door_3.doors, Data2=door.doors, Data3=door_2.doors, Data4=door_4.doors)
merge_3 = Merge(Data1=aperture_3.apertures, Data2=aperture.apertures, Data3=aperture_2.apertures, Data4=aperture_4.apertures)
merge_4 = Merge(Data1=merge_2, Data2=merge_3)
addsubface = HBAddSubface(hb_obj=flatten(merge), sub_faces=flatten(merge_4))  # -> hb_obj; plug-in component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
lb_falsestarttoggle = LBFalseStartToggle(False)
solveadj = HBSolveAdjacency(rooms=flatten(addsubface), run=lb_falsestarttoggle)  # -> out, adj_rooms; plug-in component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

# ----
panel = Panel(merge_3)
panel_2 = Panel(merge)
panel_3 = Panel(merge_4)
panel_4 = Panel(merge_2)

# ---- group: AGREGANDO INFORMAÇÕES AOS AMBIENTES
hb_building_programs = HBBuildingPrograms({"LargeOffice", "MediumOffice", "SmallOffice", "MidriseApartment", "HighriseApartment", "Retail", "StripMall", "PrimarySchool", "SecondarySchool", "SmallHotel", "LargeHotel", "Hospital", "Outpatient", "Laboratory", "Warehouse", "SuperMarket", "FullServiceRestaurant", "QuickServiceRestaurant", "Courthouse", "College", "LargeDataCenterHighITE", "LargeDataCenterLowITE", "SmallDataCenterHighITE", "SmallDataCenterLowITE"}, selected="MidriseApartment")
searchprog = HBSearchPrograms(bldg_prog=hb_building_programs)  # -> room_prog; plug-in component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
list_item = ListItem(List=searchprog, Index=0, Wrap=True)
applyprogram = HBApplyProgramType(rooms=flatten(solveadj.adj_rooms), program=list_item)  # -> out, rooms; plug-in component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
hb_building_vintages = HBBuildingVintages({"ASHRAE 90.1 2019  |  IECC 2021": "2019", "ASHRAE 90.1 2016  |  IECC 2018": "2016", "ASHRAE 90.1 2013  |  IECC 2015": "2013", "ASHRAE 90.1 2010  |  IECC 2012": "2010", "ASHRAE 90.1 2007  |  IECC 2009": "2007", "ASHRAE 90.1 2004  |  IECC 2006": "2004", "1980-2004 (CBECS)": "1980_2004", "Pre-1980 (CBECS)": "pre_1980"}, selected="ASHRAE 90.1 2019  |  IECC 2021")
hb_construction_types = HBConstructionTypes({"SteelFramed", "WoodFramed", "Mass", "Metal Building"}, selected="Mass")
hb_climate_zones = HBClimateZones({"1 - Very Hot": "1", "2 - Hot": "2", "3 - Warm": "3", "4 - Mixed": "4", "5 - Cool": "5", "6 - Cold": "6", "7 - Very Cold": "7", "8 - Subarctic": "8"}, selected="2 - Hot")
constrsetclimate = HBConstructionSetByClimate(climate_zone=hb_climate_zones, constr_type=hb_construction_types)  # -> constr_set; plug-in component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
applyconstrset = HBApplyConstructionSet(rooms=applyprogram.rooms, constr_set=constrsetclimate)  # -> rooms; plug-in component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

# ----
panel_5 = Panel(addsubface)
panel_6 = Panel(solveadj.adj_rooms)
panel_7 = Panel(searchprog)
# FERRAMENTAS DE VISUALIZAÇÃO
# DE GEOMETRIAS E INFORMAÇÕES
hb_room_energy_attributes = HBRoomEnergyAttributes({"Program": "properties.energy.program_type.display_name", "Construction Set": "properties.energy.construction_set.display_name", "Is Conditioned": "properties.energy.is_conditioned", "People per Area [ppl/m2]": "properties.energy.people.people_per_area", "Area per Person [m2/ppl]": "properties.energy.people.area_per_person", "Lighting per Area [W/m2]": "properties.energy.lighting.watts_per_area"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}, selected="Construction Set")
hb_room_attributes = HBRoomAttributes({"Display Name": "display_name", "Simulation Name (Identifier)": "identifier", "Multiplier": "multiplier", "Floor Area Excluded": "exclude_floor_area", "Story": "story", "Volume": "volume", "Gross Floor Area": "floor_area", "Exposed Area": "exposed_area", "Exterior Wall Area": "exterior_wall_area", "Exterior Aperture Area": "exterior_aperture_area", "Average Floor Elevation": "average_floor_height"}, selected="Display Name")
panel_8 = Panel(list_item)
panel_9 = Panel(applyprogram.rooms)

# ---- group: CRIANDO O MODELO COM AS GEOMETRIAS E O ENTORNO
brep_13 = Brep(<brep referenced from the Rhino model>)
shade = HBShade(geo=brep_13, name="ENTORNO")  # -> out, shades; plug-in component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
model = HBModel(rooms=flatten(applyconstrset), shades=flatten(shade.shades), name="TESTE_HB")  # -> out, model; plug-in component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

# ----
labelrooms = HBLabelRooms()  # -> label_text, base_pts, labels, wire_frame; plug-in component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
vizbytype = HBVisualizeByType()  # -> walls, interior_walls, roofs, ceilings, exterior_floors, interior_floors, air_walls, apertures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; plug-in component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
panel_10 = Panel(constrsetclimate)
panel_11 = Panel(shade.shades)

# ---- group: CONFIGURANDO A SIMULAÇÃO
boolean_toggle = BooleanToggle(True)
panel_12 = Panel("http://climate.onebuilding.org/WMO_Region_3_South_America/BRA_Brazil/BA_Bahia/BRA_BA_Salvador-Magalhaes.Intl.AP.832480_TMYx.zip")
simoutput = HBSimulationOutput(
    zone_energy_use=boolean_toggle,
    system_energy_use=boolean_toggle,
    comfort_metrics=boolean_toggle,
    surface_temperature=boolean_toggle)  # -> out, sim_output; plug-in component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
downloadepw = LBDownloadWeather(weather_URL=panel_12)  # -> epw_file, stat_file, ddy_file; plug-in component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
simpar = HBSimulationParameter(output=simoutput.sim_output, timestep=6)  # -> sim_par; plug-in component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
lb_falsestarttoggle_2 = LBFalseStartToggle(False)
file_path = FilePath("C:\Users\Nando\Desktop\HONEYBEE_EXAMPLE\")
modeltoosm = HBModelToOSM(
    model=model.model,
    epw_file=downloadepw.epw_file,
    sim_par=simpar,
    folder=file_path,
    write=Toggle(True),
    run=lb_falsestarttoggle_2)  # -> out, jsons, osw, osm, idf, sql, zsz, rdd, html; plug-in component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

# ----
panel_13 = Panel(applyconstrset)
panel_14 = Panel(model.model)

# ---- group: AVALIANDO OS RESULTADOS
faceresult = HBReadFaceResult()  # -> face_indoor_temp, face_outdoor_temp, face_energy_flow; plug-in component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
roomcomfortresult = HBReadRoomComfortResult(sql=modeltoosm.sql)  # -> oper_temp, air_temp, rad_temp, rel_humidity, unmet_heat, unmet_cool; plug-in component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
colorfaces = HBColorFaces(data=flatten(faceresult.face_indoor_temp), hb_objs=flatten(model.model))  # -> readMe, mesh, wire_frame, legend, title, faces, colors, values, vis_set; plug-in component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
colorrooms = HBColorRooms(data=flatten(roomcomfortresult.rel_humidity), rooms_model=flatten(model.model))  # -> readMe, mesh, wire_frame, legend, title, rooms, colors, values, vis_set; plug-in component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
