# Grasshopper definition HONEYBEE_EXAMPLE.gh (Grasshopper 1.0.8)
# plug-ins: LadybugGrasshopper

number_slider = Slider(0.001, range=0..1)
unit_z = UnitZ(Factor=number_slider)
unit_z_2 = UnitZ(Factor=number_slider)

brep = Brep(<brep referenced from the Rhino model>)
brep_2 = Brep(<brep referenced from the Rhino model>)
brep_3 = Brep(<brep referenced from the Rhino model>)

unit_z_3 = UnitZ(Factor=number_slider)

brep_4 = Brep(<brep referenced from the Rhino model>)
brep_5 = Brep(<brep referenced from the Rhino model>)
brep_6 = Brep([<brep referenced from the Rhino model> x2])

unit_z_4 = UnitZ(Factor=number_slider)

brep_7 = Brep(<brep referenced from the Rhino model>)
brep_8 = Brep(<brep referenced from the Rhino model>)
brep_9 = Brep(<brep referenced from the Rhino model>)

brep_10 = Brep(<brep referenced from the Rhino model>)
brep_11 = Brep(<brep referenced from the Rhino model>)
brep_12 = Brep(<brep referenced from the Rhino model>)

move = Move(Geometry=brep_3, Motion=unit_z)  # -> Geometry, Transform
move_2 = Move(Geometry=brep_6, Motion=unit_z_2)  # -> Geometry, Transform
move_3 = Move(Geometry=brep_9, Motion=unit_z_3)  # -> Geometry, Transform
move_4 = Move(Geometry=brep_12, Motion=unit_z_4)  # -> Geometry, Transform
concatenate = Concatenate(FragmentA="Porta", FragmentB="Quarto")
concatenate_2 = Concatenate(FragmentA="Janela", FragmentB="Quarto")
concatenate_3 = Concatenate(FragmentA="Porta", FragmentB="Cozinha")
concatenate_4 = Concatenate(FragmentA="Janela", FragmentB="Cozinha")
concatenate_5 = Concatenate(FragmentA="Porta", FragmentB="Banheiro")
concatenate_6 = Concatenate(FragmentA="Janela", FragmentB="Banheiro")
concatenate_7 = Concatenate(FragmentA="Porta", FragmentB="Sala")
concatenate_8 = Concatenate(FragmentA="Janela", FragmentB="Sala")
aperture = HBAperture(geo=brep_2, name=concatenate_2)  # -> out, apertures; plug-in component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
roomsolid = HBRoomFromSolid(geo=flatten(brep), name="Quarto", conditioned=Toggle(True))  # -> out, rooms; plug-in component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
door = HBDoor(geo=move.Geometry, name=concatenate)  # -> out, doors; plug-in component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
roomsolid_2 = HBRoomFromSolid(geo=flatten(brep_10), name="Sala", conditioned=Toggle(True))  # -> out, rooms; plug-in component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
aperture_2 = HBAperture(geo=brep_5, name=concatenate_4)  # -> out, apertures; plug-in component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
roomsolid_3 = HBRoomFromSolid(geo=flatten(brep_4), name="Cozinha", conditioned=Toggle(False))  # -> out, rooms; plug-in component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
aperture_3 = HBAperture(geo=brep_11, name=concatenate_8)  # -> out, apertures; plug-in component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
door_2 = HBDoor(geo=move_2.Geometry, name=concatenate_3)  # -> out, doors; plug-in component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
door_3 = HBDoor(geo=move_4.Geometry, name=concatenate_7)  # -> out, doors; plug-in component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
aperture_4 = HBAperture(geo=brep_8, name=concatenate_6)  # -> out, apertures; plug-in component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
roomsolid_4 = HBRoomFromSolid(geo=flatten(brep_7), name="Banheiro", conditioned=Toggle(False))  # -> out, rooms; plug-in component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
door_4 = HBDoor(geo=move_3.Geometry, name=concatenate_5)  # -> out, doors; plug-in component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
vizbytype = HBVisualizeByType()  # -> walls, interior_walls, roofs, ceilings, exterior_floors, interior_floors, air_walls, apertures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; plug-in component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
merge = Merge(Data1=roomsolid_2.rooms, Data2=roomsolid.rooms, Data3=roomsolid_3.rooms, Data4=roomsolid_4.rooms)
merge_2 = Merge(Data1=door_3.doors, Data2=door.doors, Data3=door_2.doors, Data4=door_4.doors)
merge_3 = Merge(Data1=aperture_3.apertures, Data2=aperture.apertures, Data3=aperture_2.apertures, Data4=aperture_4.apertures)
merge_4 = Merge(Data1=merge_2, Data2=merge_3)
lb_falsestarttoggle = LBFalseStartToggle(True)
addsubface = HBAddSubface(hb_obj=flatten(merge), sub_faces=flatten(merge_4))  # -> hb_obj; plug-in component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
brep_13 = Brep(<brep referenced from the Rhino model>)
solveadj = HBSolveAdjacency(rooms=flatten(addsubface), run=lb_falsestarttoggle)  # -> out, adj_rooms; plug-in component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
shade = HBShade(geo=brep_13, name="ENTORNO")  # -> out, shades; plug-in component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
panel = Panel(solveadj.adj_rooms)
hb_building_programs = HBBuildingPrograms({"LargeOffice", "MediumOffice", "SmallOffice", "MidriseApartment", "HighriseApartment", "Retail", "StripMall", "PrimarySchool", "SecondarySchool", "SmallHotel", "LargeHotel", "Hospital", "Outpatient", "Laboratory", "Warehouse", "SuperMarket", "FullServiceRestaurant", "QuickServiceRestaurant", "Courthouse", "College", "LargeDataCenterHighITE", "LargeDataCenterLowITE", "SmallDataCenterHighITE", "SmallDataCenterLowITE"}, selected="MidriseApartment")
hb_room_energy_attributes = HBRoomEnergyAttributes({"Program": "properties.energy.program_type.display_name", "Construction Set": "properties.energy.construction_set.display_name", "Is Conditioned": "properties.energy.is_conditioned", "People per Area [ppl/m2]": "properties.energy.people.people_per_area", "Area per Person [m2/ppl]": "properties.energy.people.area_per_person", "Lighting per Area [W/m2]": "properties.energy.lighting.watts_per_area"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}, selected="Program")
searchprog = HBSearchPrograms(bldg_prog=hb_building_programs)  # -> room_prog; plug-in component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
hb_building_vintages = HBBuildingVintages({"ASHRAE 90.1 2019  |  IECC 2021": "2019", "ASHRAE 90.1 2016  |  IECC 2018": "2016", "ASHRAE 90.1 2013  |  IECC 2015": "2013", "ASHRAE 90.1 2010  |  IECC 2012": "2010", "ASHRAE 90.1 2007  |  IECC 2009": "2007", "ASHRAE 90.1 2004  |  IECC 2006": "2004", "1980-2004 (CBECS)": "1980_2004", "Pre-1980 (CBECS)": "pre_1980"}, selected="ASHRAE 90.1 2019  |  IECC 2021")
hb_construction_types = HBConstructionTypes({"SteelFramed", "WoodFramed", "Mass", "Metal Building"}, selected="Mass")
hb_climate_zones = HBClimateZones({"1 - Very Hot": "1", "2 - Hot": "2", "3 - Warm": "3", "4 - Mixed": "4", "5 - Cool": "5", "6 - Cold": "6", "7 - Very Cold": "7", "8 - Subarctic": "8"}, selected="2 - Hot")
model = HBModel(rooms=flatten(solveadj.adj_rooms), shades=flatten(shade.shades), name="TESTE_HB")  # -> out, model; plug-in component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
applyprogram = HBApplyProgramType(program=searchprog)  # -> out, rooms; plug-in component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
labelrooms = HBLabelRooms(attribute=hb_room_energy_attributes)  # -> label_text, base_pts, labels, wire_frame; plug-in component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
constrsetclimate = HBConstructionSetByClimate(climate_zone=hb_climate_zones, vintage=hb_building_vintages, constr_type=hb_construction_types)  # -> constr_set; plug-in component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
applyconstrset = HBApplyConstructionSet(rooms=applyprogram.rooms, constr_set=constrsetclimate)  # -> rooms; plug-in component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
simoutput = HBSimulationOutput()  # -> out, sim_output; plug-in component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
simpar = HBSimulationParameter(output=simoutput.sim_output, timestep=6)  # -> sim_par; plug-in component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
lb_falsestarttoggle_2 = LBFalseStartToggle(False)
modeltoosm = HBModelToOSM(sim_par=simpar, write=Toggle(False), run=lb_falsestarttoggle_2)  # -> out, jsons, osw, osm, idf, sql, zsz, rdd, html; plug-in component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
