# Grasshopper definition inferface_básica_final.gh (Grasshopper 1.0.7)

ladybug = Ladybug_Ladybug()  # -> out; plug-in component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
panel = Panel(ladybug)
gradientlibrary = Ladybug_GradientLibrary(gradIndex=Slider(4, range=0..23))  # -> customColors; plug-in component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
outdoorcomfortcalculator = Ladybug_OutdoorComfortCalculator(dryBulbTemperature=Slider(23, range=-20..80), relativeHumidity=Slider(70, range=0..100), runIt=Toggle(True))  # -> out, port, universalThermalClimateIndex, comfortableOrNot, thermalStress, conditionOfPerson, port_2, percentOfTimeComfortable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; plug-in component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
legendpar = Ladybug_LegendParameters(
    lowBound=Slider(13, range=0..21),
    highBound=Slider(40, range=0..40),
    numSegments=Slider(17, range=0..30),
    customColors=flatten(gradientlibrary),
    decimalPlaces=Slider(1, range=0..4))  # -> legendPar; plug-in component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
comfortmannequin = Ladybug_ComfortMannequin(
    ambientTemperature=outdoorcomfortcalculator.universalThermalClimateIndex,
    targetTemperature=Slider(24, range=0..30),
    comfortRange=Slider(2, range=0..3),
    bodyPosture=Slider(2, range=0..2),
    legendPar=legendpar)  # -> mannequinMesh, legend, legendBasePt; plug-in component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
panel_2 = Panel(outdoorcomfortcalculator.universalThermalClimateIndex)
