# Grasshopper definition radiation_02_1_3_0.gh (Grasshopper 1.0.7)
# plug-ins: LadybugGrasshopper

panel = Panel("http://climate.onebuilding.org/WMO_Region_3_South_America/BRA_Brazil/BA_Bahia/BRA_BA_Salvador-Magalhaes.Intl.AP.832480_TMYx.zip")
lb_falsestarttoggle = LBFalseStartToggle(False)
epwmap = LBEPWmap(epw_map=lb_falsestarttoggle)  # -> Output; plug-in component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
downloadepw = LBDownloadWeather(weather_URL=panel)  # -> epw_file, stat_file, ddy_file; plug-in component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
panel_2 = Panel(epwmap)
importepw = LBImportEPW(epw_file=downloadepw.epw_file)  # -> location, dry_bulb_temperature, dew_point_temperature, relative_humidity, wind_speed, wind_direction, direct_normal_rad, diffuse_horizontal_rad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; plug-in component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
lb_falsestarttoggle_2 = LBFalseStartToggle(False)
skymatrix = LBCumulativeSkyMatrix(location=importepw.location, direct_rad=importepw.direct_normal_rad, diffuse_rad=importepw.diffuse_horizontal_rad)  # -> out, sky_mtx; plug-in component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
skydome = LBSkyDome(sky_mtx=skymatrix.sky_mtx, show_comp=lb_falsestarttoggle_2)  # -> out, mesh, compass, legend, title, patch_vecs, patch_values, mesh_values; plug-in component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
