# Grasshopper definition radiation_03_somas.gh (Grasshopper 1.0.7)

panel = Panel("https://www.energyplus.net/weather-download/south_america_wmo_region_3/BRA//BRA_Salvador.832290_SWERA/all")
ladybug = Ladybug_Ladybug()  # -> out; plug-in component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
panel_2 = Panel(ladybug)
downloadepw = Ladybug_downloadEPWWeatherFile(download=Toggle(False))  # -> Output; plug-in component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
epw_stat = Ladybug_OpenEPWAndSTATWeatherFiles(weatherFileURL=panel)  # -> epwFile, statFile; plug-in component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
boolean_toggle = BooleanToggle(True)
panel_3 = Panel(downloadepw)
gencumulativeskymtx = Ladybug_GenCumulativeSkyMtx(epwFile=epw_stat.epwFile, skyDensity=0, useOldRes=True, runIt=boolean_toggle)  # -> out, cumulativeSkyMtx; plug-in component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

point = Point(<point referenced from the Rhino model>)
unit_z = UnitZ(Factor=Slider(150, range=0..150))
move = Move(Geometry=point, Motion=unit_z)  # -> Geometry, Transform

selectskymtx = Ladybug_selectSkyMtx(cumulativeSkyMtx=gencumulativeskymtx.cumulativeSkyMtx, removeDiffuse=False, removeDirect=False)  # -> out, selectedSkyMtx; plug-in component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
selectskymtx_2 = Ladybug_selectSkyMtx(cumulativeSkyMtx=gencumulativeskymtx.cumulativeSkyMtx, removeDiffuse=False, removeDirect=boolean_toggle)  # -> out, selectedSkyMtx; plug-in component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
selectskymtx_3 = Ladybug_selectSkyMtx(cumulativeSkyMtx=gencumulativeskymtx.cumulativeSkyMtx, removeDiffuse=boolean_toggle, removeDirect=False)  # -> out, selectedSkyMtx; plug-in component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

# ---- group: Norte
curve = Curve(<curve referenced from the Rhino model>)
end_points = EndPoints(Curve=curve)  # -> Start, End
vector_2pt = Vector2Pt(PointA=end_points.Start, PointB=end_points.End, Unitize=False)  # -> Vector, Length
northarrow = Ladybug_North(north=vector_2pt.Vector, centerPt=end_points.Start, scale=Slider(4, range=0.001..10))  # -> northSign; plug-in component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

# ----
brep = Brep([<brep referenced from the Rhino model> x2])
radiationrose = Ladybug_RadiationRose(
    north=vector_2pt.Vector,
    selectedSkyMtx=selectskymtx.selectedSkyMtx,
    context=flatten(brep),
    centerPoint=move.Geometry,
    arrowHeadScale=1,
    runIt=Toggle(True))  # -> out, radiationArrowsMesh, radRoseBaseCrvs, legend, legendBasePts, radRoseEndPts, radRoseValues; plug-in component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
radiationrose_2 = Ladybug_RadiationRose(
    north=vector_2pt.Vector,
    selectedSkyMtx=selectskymtx_2.selectedSkyMtx,
    context=flatten(brep),
    centerPoint=move.Geometry,
    arrowHeadScale=1,
    runIt=Toggle(True))  # -> out, radiationArrowsMesh, radRoseBaseCrvs, legend, legendBasePts, radRoseEndPts, radRoseValues; plug-in component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
radiationrose_3 = Ladybug_RadiationRose(
    north=vector_2pt.Vector,
    selectedSkyMtx=selectskymtx_3.selectedSkyMtx,
    context=flatten(brep),
    centerPoint=move.Geometry,
    arrowHeadScale=1,
    runIt=Toggle(True))  # -> out, radiationArrowsMesh, radRoseBaseCrvs, legend, legendBasePts, radRoseEndPts, radRoseValues; plug-in component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
mass_addition = MassAddition(Input=radiationrose.radRoseValues)  # -> Result, PartialResults
mass_addition_2 = MassAddition(Input=radiationrose_2.radRoseValues)  # -> Result, PartialResults
mass_addition_3 = MassAddition(Input=radiationrose_3.radRoseValues)  # -> Result, PartialResults
panel_4 = Panel(mass_addition.Result)
panel_5 = Panel(mass_addition_2.Result)
panel_6 = Panel(mass_addition_3.Result)
cull_index = CullIndex(List=flatten(mass_addition.Result), Indices="0", Wrap=True)
cull_index_2 = CullIndex(List=flatten(mass_addition_2.Result), Indices="0", Wrap=True)
cull_index_3 = CullIndex(List=flatten(mass_addition_3.Result), Indices="0", Wrap=True)
list_item = ListItem(List=flatten(cull_index_3), Index="1", Wrap=True)
list_item_2 = ListItem(List=flatten(cull_index_2), Index=0, Wrap=True)
mass_addition_4 = MassAddition(Input=cull_index)  # -> Result, PartialResults
panel_7 = Panel(cull_index)
mass_addition_5 = MassAddition(Input=cull_index_2)  # -> Result, PartialResults
mass_addition_6 = MassAddition(Input=cull_index_3)  # -> Result, PartialResults
panel_8 = Panel(cull_index_2)
panel_9 = Panel(cull_index_3)
panel_10 = Panel(list_item)
panel_11 = Panel(list_item_2)
panel_12 = Panel(mass_addition_4.Result)
panel_13 = Panel(mass_addition_5.Result)
panel_14 = Panel(mass_addition_6.Result)
addition = Addition(A=panel_11, B=panel_10)
panel_15 = Panel(addition)
