# Grasshopper definition radiation_03_teste.gh (Grasshopper 1.0.7)

panel = Panel("https://www.energyplus.net/weather-download/south_america_wmo_region_3/BRA//BRA_Salvador.832290_SWERA/all")
ladybug = Ladybug_Ladybug()  # -> out; plug-in component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
panel_2 = Panel(ladybug)
downloadepw = Ladybug_downloadEPWWeatherFile(download=Toggle(False))  # -> Output; plug-in component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
epw_stat = Ladybug_OpenEPWAndSTATWeatherFiles(weatherFileURL=panel)  # -> epwFile, statFile; plug-in component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
panel_3 = Panel(downloadepw)
gencumulativeskymtx = Ladybug_GenCumulativeSkyMtx(epwFile=epw_stat.epwFile, skyDensity=0, useOldRes=True, runIt=Toggle(True))  # -> out, cumulativeSkyMtx; plug-in component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

point = Point(<point referenced from the Rhino model>)
unit_z = UnitZ(Factor=Slider(150, range=0..150))
move = Move(Geometry=point, Motion=unit_z)  # -> Geometry, Transform

selectskymtx = Ladybug_selectSkyMtx(cumulativeSkyMtx=gencumulativeskymtx.cumulativeSkyMtx, removeDiffuse=False, removeDirect=False)  # -> out, selectedSkyMtx; plug-in component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

# ---- group: Norte
curve = Curve(<curve referenced from the Rhino model>)
end_points = EndPoints(Curve=curve)  # -> Start, End
vector_2pt = Vector2Pt(PointA=end_points.Start, PointB=end_points.End, Unitize=False)  # -> Vector, Length
northarrow = Ladybug_North(north=vector_2pt.Vector, centerPt=end_points.Start, scale=Slider(4, range=0.001..10))  # -> northSign; plug-in component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

# ----
brep = Brep([<brep referenced from the Rhino model> x2])
radiationrose = Ladybug_RadiationRose(
    north=vector_2pt.Vector,
    selectedSkyMtx=selectskymtx.selectedSkyMtx,
    context=flatten(brep),
    centerPoint=move.Geometry,
    arrowHeadScale=1,
    runIt=Toggle(False))  # -> out, radiationArrowsMesh, radRoseBaseCrvs, legend, legendBasePts, radRoseEndPts, radRoseValues; plug-in component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
param_viewer = ParamViewer(radiationrose.radRoseValues)
panel_4 = Panel(radiationrose.radRoseValues)
mass_addition = MassAddition(Input=radiationrose.radRoseValues)  # -> Result, PartialResults
flatten_tree = FlattenTree(Tree=mass_addition.Result, Path="{0}")
panel_5 = Panel(mass_addition.Result)
cull_index = CullIndex(List=flatten_tree, Indices="0", Wrap=True)
mass_addition_2 = MassAddition(Input=cull_index)  # -> Result, PartialResults
panel_6 = Panel(cull_index)
panel_7 = Panel(mass_addition_2.Result)
