# Grasshopper definition radiation_04_1_3_0.gh (Grasshopper 1.0.7)
# plug-ins: LadybugGrasshopper

panel = Panel("http://climate.onebuilding.org/WMO_Region_3_South_America/BRA_Brazil/BA_Bahia/BRA_BA_Salvador-Magalhaes.Intl.AP.832480_TMYx.zip")
lb_falsestarttoggle = LBFalseStartToggle(False)
construct_domain = ConstructDomain(DomainStart=0, DomainEnd="360")
epwmap = LBEPWmap(epw_map=lb_falsestarttoggle)  # -> Output; plug-in component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
range = Range(Domain=construct_domain, Steps=Slider(360, range=0..360))
downloadepw = LBDownloadWeather(weather_URL=panel)  # -> epw_file, stat_file, ddy_file; plug-in component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
panel_2 = Panel(epwmap)

# ---- group: Geometria
brep = Brep(<brep referenced from the Rhino model>)

# ----
importepw = LBImportEPW(epw_file=downloadepw.epw_file)  # -> location, dry_bulb_temperature, dew_point_temperature, relative_humidity, wind_speed, wind_direction, direct_normal_rad, diffuse_horizontal_rad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; plug-in component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
point = Point(<point referenced from the Rhino model>)
rotate = Rotate(Geometry=brep, Angle=degrees(range), Plane=point)  # -> Geometry, Transform
skymatrix = LBCumulativeSkyMatrix(location=importepw.location, direct_rad=importepw.direct_normal_rad, diffuse_rad=importepw.diffuse_horizontal_rad)  # -> out, sky_mtx; plug-in component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

# ---- group: Contexto
brep_2 = Brep([<brep referenced from the Rhino model> x2])

# ----
lb_falsestarttoggle_2 = LBFalseStartToggle(True)
incidentradiation = LBIncidentRadiation(
    sky_mtx=skymatrix.sky_mtx,
    geometry=graft(rotate.Geometry),
    context=flatten(brep_2),
    grid_size=Slider(5.7, range=0.5..10),
    offset_dist=Slider(0.1, range=0..1),
    run=lb_falsestarttoggle_2)  # -> out, points, results, total, mesh, legend, title, int_mtx; plug-in component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
sort_list = SortList(Keys=flatten(incidentradiation.total), ValuesValuesA=range)  # -> Keys, ValuesValuesA
panel_3 = Panel(sort_list.Keys)
panel_4 = Panel(sort_list.ValuesValuesA)
