# Grasshopper definition sunpath.gh (Grasshopper 1.0.7)

panel = Panel("https://www.energyplus.net/weather-download/south_america_wmo_region_3/BRA//BRA_Salvador.832290_SWERA/all")
ladybug = Ladybug_Ladybug()  # -> out; plug-in component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
downloadepw = Ladybug_downloadEPWWeatherFile(download=Toggle(False))  # -> Output; plug-in component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
panel_2 = Panel(ladybug)
panel_3 = Panel(downloadepw)
epw_stat = Ladybug_OpenEPWAndSTATWeatherFiles(weatherFileURL=panel)  # -> epwFile, statFile; plug-in component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
importepw = Ladybug_ImportEpw(epwFile=epw_stat.epwFile)  # -> Output, latitude, location, dryBulbTemperature, dewPointTemperature, relativeHumidity, windSpeed, windDirection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; plug-in component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
series = Series(Start="1", Step="1", Count="24")
analysisperiod = Ladybug_AnalysisPeriod(
    fromMonth=Slider(12, range=1..12),
    fromDay=Slider(21, range=1..31),
    fromHour=Slider(1, range=1..24),
    toMonth=Slider(3, range=1..12),
    toDay=Slider(21, range=1..31),
    toHour=Slider(24, range=1..24))  # -> out, analysisPeriod; plug-in component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
point = Point(<point referenced from the Rhino model>)
sunpath = Ladybug_SunPath(
    location=importepw.location,
    hour=12,
    day=21,
    month=12,
    timeStep=1,
    analysisPeriod=analysisperiod.analysisPeriod,
    centerPt=point,
    projection=Slider(0, range=0..2),
    annualHourlyData=flatten(importepw.dryBulbTemperature),
    dailyOrAnnualSunPath=True)  # -> out, sunVectors, sunAltitudes, sunAzimuths, port, sunSpheresMesh, sunPathCrvs, compassCrvs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; plug-in component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
panel_4 = Panel(analysisperiod.analysisPeriod)
