# Grasshopper definition sunpath_02.gh (Grasshopper 1.0.7)

# ---- group: Meses 3, 6, 9 e 12
multiplication = Multiplication(A=Slider(4, range=1..4), B="3")
panel = Panel(multiplication)

# ----
panel_2 = Panel("https://www.energyplus.net/weather-download/south_america_wmo_region_3/BRA//BRA_Salvador.832290_SWERA/all")
ladybug = Ladybug_Ladybug()  # -> out; plug-in component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
downloadepw = Ladybug_downloadEPWWeatherFile(download=Toggle(False))  # -> Output; plug-in component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
panel_3 = Panel(ladybug)
panel_4 = Panel(downloadepw)
epw_stat = Ladybug_OpenEPWAndSTATWeatherFiles(weatherFileURL=panel_2)  # -> epwFile, statFile; plug-in component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

# ---- group: Norte
curve = Curve(<curve referenced from the Rhino model>)
end_points = EndPoints(Curve=curve)  # -> Start, End
vector_2pt = Vector2Pt(PointA=end_points.Start, PointB=end_points.End, Unitize=False)  # -> Vector, Length
northarrow = Ladybug_North(north=vector_2pt.Vector, centerPt=end_points.Start, scale=Slider(4, range=0.001..10))  # -> northSign; plug-in component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

# ----
importepw = Ladybug_ImportEpw(epwFile=epw_stat.epwFile)  # -> Output, latitude, location, dryBulbTemperature, dewPointTemperature, relativeHumidity, windSpeed, windDirection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; plug-in component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

# ---- group: horas do dia
series = Series(Start="1", Step="1", Count="24")
panel_5 = Panel(series)

# ----
boolean_toggle = BooleanToggle(False)
sunpath = Ladybug_SunPath(
    north=vector_2pt.Vector,
    location=importepw.location,
    hour=series,
    day=21,
    month=multiplication,
    timeStep=1,
    dailyOrAnnualSunPath=True,
    bakeIt=boolean_toggle)  # -> out, sunVectors, sunAltitudes, sunAzimuths, port, sunSpheresMesh, sunPathCrvs, compassCrvs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; plug-in component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
panel_6 = Panel(sunpath.sunVectors)

# ---- group: Ajustes da imagem
list_length = ListLength(List=sunpath.sunVectors)
gradientlibrary = Ladybug_GradientLibrary(gradIndex=Slider(16, range=0..23))  # -> customColors; plug-in component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
point = Point(<point referenced from the Rhino model>)
legendpar = Ladybug_LegendParameters(lowBound="0", highBound=list_length, customColors=flatten(gradientlibrary), legendLocation=point)  # -> legendPar; plug-in component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

# ---- group: entorno
brep = Brep([<brep referenced from the Rhino model> x2])

# ----
panel_7 = Panel(list_length)

# ---- group: superfícies para análise
brep_2 = Brep(<brep referenced from the Rhino model>)

# ----
sunlighthoursanalysis = Ladybug_SunlightHoursAnalysis(
    north=vector_2pt.Vector,
    geometry=flatten(brep_2),
    context=flatten(brep),
    gridSize=Slider(1, range=0.1..10),
    disFromBase=Slider(0.01, range=0.01..1),
    sunVectors=flatten(sunpath.sunVectors),
    timeStep=1,
    legendPar=flatten(legendpar),
    runIt=Toggle(False),
    bakeIt=boolean_toggle)  # -> out, contextMesh, analysisMesh, testPts, testVec, port, sunlightHoursResult, sunlightHoursMesh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; plug-in component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
