# Grasshopper definition sunpath_DAYL_LIGHT_HOURS_ANALISE_FINAL.gh (Grasshopper 1.0.7)

panel = Panel("https://www.energyplus.net/weather-download/south_america_wmo_region_3/BRA//BRA_Salvador.832290_SWERA/all")
ladybug = Ladybug_Ladybug()  # -> out; plug-in component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
downloadepw = Ladybug_downloadEPWWeatherFile(download=Toggle(False))  # -> Output; plug-in component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
panel_2 = Panel(ladybug)
panel_3 = Panel(downloadepw)
epw_stat = Ladybug_OpenEPWAndSTATWeatherFiles(weatherFileURL=panel)  # -> epwFile, statFile; plug-in component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
importepw = Ladybug_ImportEpw(epwFile=epw_stat.epwFile)  # -> Output, latitude, location, dryBulbTemperature, dewPointTemperature, relativeHumidity, windSpeed, windDirection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; plug-in component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
series = Series(Start="1", Step="1", Count="24")
analysisperiod = Ladybug_AnalysisPeriod(
    fromMonth=Slider(12, range=1..12),
    fromDay=Slider(21, range=1..31),
    fromHour=Slider(1, range=1..24),
    toMonth=Slider(3, range=1..12),
    toDay=Slider(21, range=1..31),
    toHour=Slider(24, range=1..24))  # -> out, analysisPeriod; plug-in component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
panel_4 = Panel(series)
multiplication = Multiplication(A=Slider(2, range=1..4), B="3")
panel_5 = Panel(analysisperiod.analysisPeriod)
panel_6 = Panel(multiplication)
sunpath = Ladybug_SunPath(
    location=importepw.location,
    hour=series,
    day=21,
    month=12,
    timeStep=1,
    projection=Slider(0, range=0..2),
    dailyOrAnnualSunPath=True)  # -> out, sunVectors, sunAltitudes, sunAzimuths, port, sunSpheresMesh, sunPathCrvs, compassCrvs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; plug-in component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
panel_7 = Panel(sunpath.sunVectors)
list_length = ListLength(List=panel_7)

# ---- group: Norte verdadeiro
curve = Curve(<curve referenced from the Rhino model>)
end_points = EndPoints(Curve=curve)  # -> Start, End
vector_2pt = Vector2Pt(PointA=end_points.Start, PointB=end_points.End, Unitize=False)  # -> Vector, Length
northarrow = Ladybug_North(north=vector_2pt.Vector, centerPt=end_points.Start, scale=Slider(4, range=0.001..10))  # -> northSign; plug-in component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

# ----
gradientlibrary = Ladybug_GradientLibrary(gradIndex=Slider(16, range=0..23))  # -> customColors; plug-in component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
point = Point(<point referenced from the Rhino model>)
panel_8 = Panel(list_length)

# ---- group: SUPERFÍCIES DE ANÁLISE
brep = Brep(<brep referenced from the Rhino model>)

# ---- group: Entorno
entorno = Brep([<brep referenced from the Rhino model> x2])

# ----
legendpar = Ladybug_LegendParameters(lowBound="0", highBound=list_length, customColors=flatten(gradientlibrary), legendLocation=point)  # -> legendPar; plug-in component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
sunlighthoursanalysis = Ladybug_SunlightHoursAnalysis(
    north=vector_2pt.Vector,
    geometry=flatten(brep),
    context=flatten(entorno),
    gridSize=Slider(1, range=1..10),
    disFromBase=Slider(0.001, range=0..1),
    sunVectors=flatten(sunpath.sunVectors),
    timeStep=1,
    legendPar=flatten(legendpar),
    parallel=Toggle(True),
    runIt=Toggle(True))  # -> out, contextMesh, analysisMesh, testPts, testVec, port, sunlightHoursResult, sunlightHoursMesh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; plug-in component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
panel_9 = Panel(sunlighthoursanalysis.totalSunlightHours)
panel_10 = Panel(sunlighthoursanalysis.out)
