# Grasshopper definition sunpath_DAYL_LIGHT_HOURS_ANALISE_FINAL_1_3_0.gh (Grasshopper 1.0.7)
# plug-ins: LadybugGrasshopper

lb_falsestarttoggle = LBFalseStartToggle(False)
panel = Panel("http://climate.onebuilding.org/WMO_Region_3_South_America/BRA_Brazil/BA_Bahia/BRA_BA_Salvador-Magalhaes.Intl.AP.832480_TMYx.zip")
epwmap = LBEPWmap(epw_map=lb_falsestarttoggle)  # -> Output; plug-in component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
series = Series(Start="0", Step="1", Count="24")
panel_2 = Panel(epwmap)

# ---- group: Norte verdadeiro
curve = Curve(<curve referenced from the Rhino model>)
end_points = EndPoints(Curve=curve)  # -> Start, End
vector_2pt = Vector2Pt(PointA=end_points.Start, PointB=end_points.End, Unitize=False)  # -> Vector, Length
unit_y = UnitY(Factor=1)
xy_plane = XYPlane(Origin=Point(0, 0, 0))
angle = Angle(VectorA=unit_y, VectorB=vector_2pt.Vector, Plane=xy_plane)  # -> Angle, Reflex
degrees = Degrees(Radians=angle.Angle)
compass = LBCompass(north=degrees, center=end_points.Start, scale=Slider(4, range=0.001..10))  # -> compass; plug-in component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

# ----
downloadepw = LBDownloadWeather(weather_URL=panel)  # -> epw_file, stat_file, ddy_file; plug-in component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
analysisperiod = LBAnalysisPeriod(
    start_month=Slider(1, range=1..12),
    start_day=Slider(1, range=1..31),
    start_hour=Slider(0, range=0..23),
    end_month=Slider(12, range=1..12),
    end_day=Slider(31, range=1..31),
    end_hour=Slider(23, range=0..23))  # -> period, hoys, dates; plug-in component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
panel_3 = Panel(series)
multiplication = Multiplication(A=Slider(2, range=1..4), B="3")
panel_4 = Panel(analysisperiod.period)
importepw = LBImportEPW(epw_file=downloadepw.epw_file)  # -> location, dry_bulb_temperature, dew_point_temperature, relative_humidity, wind_speed, wind_direction, direct_normal_rad, diffuse_horizontal_rad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; plug-in component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
panel_5 = Panel(multiplication)
sunpath = LBSunPath(north=degrees, location=importepw.location, hoys=analysisperiod.hoys, scale=1)  # -> out, vectors, altitudes, azimuths, hoys, sun_pts, analemma, daily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; plug-in component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
panel_6 = Panel(sunpath.vectors)
list_length = ListLength(List=panel_6)
panel_7 = Panel(list_length)
panel_8 = Panel("0")
point = Point(<point referenced from the Rhino model>)
colrange = LBColorRange(index=Slider(22, range=0..23))  # -> colors; plug-in component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

# ---- group: SUPERFÍCIES DE ANÁLISE
brep = Brep(<brep referenced from the Rhino model>)

# ----
legendpar = LBLegendParameters(continuous_leg=colrange, base_plane=point)  # -> leg_par; plug-in component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
lb_falsestarttoggle_2 = LBFalseStartToggle(False)

# ---- group: Entorno
entorno = Brep([<brep referenced from the Rhino model> x2])

# ----
directsunhours = LBDirectSunHours(
    vectors=flatten(sunpath.vectors),
    geometry=flatten(brep),
    context=flatten(entorno),
    grid_size=Slider(5, range=1..10),
    offset_dist=Slider(0.001, range=0..1),
    legend_par=legendpar,
    cpu_count=Slider(3, range=0..5),
    run=lb_falsestarttoggle_2)  # -> out, points, results, mesh, legend, title, int_mtx; plug-in component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
