# Grasshopper definition direct_diffuse_total.gh (Grasshopper 1.0.7)
# plug-ins: LadybugGrasshopper

panel = Panel("http://climate.onebuilding.org/WMO_Region_3_South_America/BRA_Brazil/BA_Bahia/BRA_BA_Salvador-Magalhaes.Intl.AP.832480_TMYx.zip")
lb_falsestarttoggle = LBFalseStartToggle(False)
epwmap = LBEPWmap(epw_map=lb_falsestarttoggle)  # -> Output; plug-in component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
panel_2 = Panel(epwmap)
downloadepw = LBDownloadWeather(weather_URL=panel)  # -> epw_file, stat_file, ddy_file; plug-in component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
importepw = LBImportEPW(epw_file=downloadepw.epw_file)  # -> location, dry_bulb_temperature, dew_point_temperature, relative_humidity, wind_speed, wind_direction, direct_normal_rad, diffuse_horizontal_rad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; plug-in component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
xdata = LBDeconstructData(data=importepw.diffuse_horizontal_rad)  # -> header, values; plug-in component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
list_length = ListLength(List=xdata.values)
rectangle = Rectangle(Plane=PlaneXY(0, 0, 0), XSize=Domain(-1, 1), YSize=Domain(-2, 2), Radius=0)  # -> Rectangle, Length
duplicate_data = DuplicateData(Data="0", Number=list_length, Order=True)
data = LBConstructData(header=xdata.header, values=duplicate_data)  # -> data; plug-in component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
box_rectangle = BoxRectangle(Rectangle=rectangle.Rectangle, Height=Slider(10, range=0..20))
lb_falsestarttoggle_2 = LBFalseStartToggle(True)
number_slider = Slider(3, range=0..10)

# ---- group: direct
# direct radiation
skymatrix = LBCumulativeSkyMatrix(location=importepw.location, direct_rad=importepw.direct_normal_rad, diffuse_rad=data)  # -> out, sky_mtx; plug-in component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
incidentradiation = LBIncidentRadiation(sky_mtx=skymatrix.sky_mtx, geometry=flatten(box_rectangle), grid_size=number_slider, run=lb_falsestarttoggle_2)  # -> out, points, results, total, mesh, legend, title, int_mtx; plug-in component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

# ---- group: Total Radiation
# Total radiation
skymatrix_2 = LBCumulativeSkyMatrix(location=importepw.location, direct_rad=importepw.direct_normal_rad, diffuse_rad=importepw.diffuse_horizontal_rad)  # -> out, sky_mtx; plug-in component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
incidentradiation_2 = LBIncidentRadiation(sky_mtx=skymatrix_2.sky_mtx, geometry=flatten(box_rectangle), grid_size=number_slider, run=lb_falsestarttoggle_2)  # -> out, points, results, total, mesh, legend, title, int_mtx; plug-in component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

# ---- group: Diffuse
skymatrix_3 = LBCumulativeSkyMatrix(location=importepw.location, direct_rad=data, diffuse_rad=importepw.diffuse_horizontal_rad)  # -> out, sky_mtx; plug-in component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
incidentradiation_3 = LBIncidentRadiation(sky_mtx=skymatrix_3.sky_mtx, geometry=flatten(box_rectangle), grid_size=number_slider, run=lb_falsestarttoggle_2)  # -> out, points, results, total, mesh, legend, title, int_mtx; plug-in component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

# ----
panel_3 = Panel(incidentradiation_3.total)
panel_4 = Panel(incidentradiation.total)
addition = Addition(A=panel_4, B=panel_3)
panel_5 = Panel(incidentradiation_3.results)
panel_6 = Panel(incidentradiation.results)
addition_2 = Addition(A=panel_6, B=panel_5)
panel_7 = Panel(addition)
panel_8 = Panel(incidentradiation_2.total)
panel_9 = Panel(addition_2)
panel_10 = Panel(incidentradiation_2.results)
