# Grasshopper definition avaliando_epw.gh (Grasshopper 1.0.7)

ladybug = Ladybug_Ladybug()  # -> out; plug-in component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
panel = Panel("https://www.energyplus.net/weather-download/south_america_wmo_region_3/BRA//BRA_Salvador.832290_SWERA/all")
downloadepw = Ladybug_downloadEPWWeatherFile(download=Toggle(False))  # -> Output; plug-in component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
panel_2 = Panel(ladybug)
panel_3 = Panel(downloadepw)
epw_stat = Ladybug_OpenEPWAndSTATWeatherFiles(weatherFileURL=panel)  # -> epwFile, statFile; plug-in component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
importepw = Ladybug_ImportEpw(epwFile=epw_stat.epwFile)  # -> Output, latitude, location, dryBulbTemperature, dewPointTemperature, relativeHumidity, windSpeed, windDirection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; plug-in component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
panel_4 = Panel(importepw.latitude)
panel_5 = Panel(importepw.Output)
explodelocation = Ladybug_DecomposeLocation(location=importepw.location)  # -> locationName, latitude, longitude, timeZone, elevation; plug-in component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
panel_6 = Panel(importepw.modelYear)
strnum = Ladybug_SeparateData(inputList=flatten(importepw.windDirection))  # -> numbers, strings; plug-in component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
strnum_2 = Ladybug_SeparateData(inputList=flatten(importepw.modelYear))  # -> numbers, strings; plug-in component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
panel_7 = Panel(explodelocation.longitude)
panel_8 = Panel(explodelocation.timeZone)
panel_9 = Panel(explodelocation.latitude)
create_set = CreateSet(List=strnum.numbers)  # -> Set, Map
create_set_2 = CreateSet(List=strnum_2.numbers)  # -> Set, Map
panel_10 = Panel(explodelocation.elevation)
panel_11 = Panel(explodelocation.locationName)
panel_12 = Panel(create_set_2.Set)
sort_list = SortList(Keys=create_set.Set)  # -> Keys, ValuesValuesA
sort_list_2 = SortList(Keys=create_set_2.Set)  # -> Keys, ValuesValuesA
panel_13 = Panel(sort_list.Keys)
panel_14 = Panel(create_set.Set)
panel_15 = Panel(sort_list_2.Keys)
list_length = ListLength(List=panel_13)
list_length_2 = ListLength(List=panel_15)
panel_16 = Panel(list_length)
panel_17 = Panel(list_length_2)
