# Grasshopper definition galapagos_exemplo_teorico.gh (Grasshopper 1.0.7)

brep = Brep(<brep referenced from the Rhino model>)
volume = Volume(Geometry=brep)  # -> Volume, Centroid
xy_plane = XYPlane(Origin=Point(0, 0, 0))
number_slider = Slider(0, range=0..360)
number_slider_2 = Slider(0, range=0..360)
number_slider_3 = Slider(0, range=0..360)
construct_domain = ConstructDomain(DomainStart="0", DomainEnd="360")
plane_origin = PlaneOrigin(Base=xy_plane, Origin=volume.Centroid)
deconstruct_plane = DeconstructPlane(Plane=plane_origin)  # -> Origin, XAxis, YAxis, ZAxis
range = Range(Domain=construct_domain, Steps=Slider(360, range=0..1000))
longest_list = LongestList(ListA=range, ListB=range, PaddingMode=2)  # -> ListA, ListB
rotate_3d = Rotate3D(Geometry=brep, Angle=degrees(number_slider_3), Center=deconstruct_plane.Origin, Axis=deconstruct_plane.XAxis)  # -> Geometry, Transform
rotate_3d_2 = Rotate3D(Geometry=rotate_3d.Geometry, Angle=degrees(number_slider), Center=deconstruct_plane.Origin, Axis=deconstruct_plane.YAxis)  # -> Geometry, Transform
rotate_3d_3 = Rotate3D(
    Geometry=rotate_3d_2.Geometry,
    Angle=degrees(number_slider_2),
    Center=deconstruct_plane.Origin,
    Axis=deconstruct_plane.ZAxis)  # -> Geometry, Transform
bounding_box = BoundingBox(Content=rotate_3d_3.Geometry, Plane=xy_plane)  # -> Box, Box_2
volume_2 = Volume(Geometry=bounding_box.Box)  # -> Volume, Centroid
galapagos = Galapagos(fitness=volume_2, gene=[number_slider_3, number_slider, number_slider_2])
panel = Panel(volume_2.Volume)
