# Grasshopper definition galapagos_lb.gh (Grasshopper 1.0.7)
# plug-ins: LadybugGrasshopper

number_slider = Slider(1, range=1..100)
curve = Curve(<curve referenced from the Rhino model>)
curve_2 = Curve(<curve referenced from the Rhino model>)

# ---- group: EPW
panel = Panel("http://climate.onebuilding.org/WMO_Region_3_South_America/BRA_Brazil/BA_Bahia/BRA_BA_Salvador-Magalhaes.Intl.AP.832480_TMYx.zip")
lb_falsestarttoggle = LBFalseStartToggle(False)
epwmap = LBEPWmap(epw_map=lb_falsestarttoggle)  # -> Output; plug-in component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
downloadepw = LBDownloadWeather(weather_URL=panel)  # -> epw_file, stat_file, ddy_file; plug-in component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
file_path = FilePath("C:\ladybug\BRA_BA_Salvador-Magalhaes.Intl.AP.832480_TMYx\BRA_BA_Salvador-Magalhaes.Intl.AP.832480_TMYx.epw")
importepw = LBImportEPW(epw_file=file_path)  # -> location, dry_bulb_temperature, dew_point_temperature, relative_humidity, wind_speed, wind_direction, direct_normal_rad, diffuse_horizontal_rad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; plug-in component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

# ----
divide_curve = DivideCurve(Curve=curve, Count=number_slider, Kinks=False)  # -> Points, Tangents, Parameters

# ---- group: Criação dos eixos dos montantes
divide_curve_2 = DivideCurve(Curve=curve_2, Count=number_slider, Kinks=False)  # -> Points, Tangents, Parameters
line = Line(StartPoint=divide_curve_2.Points, EndPoint=divide_curve.Points)

# ----
panel_2 = Panel(curve_2)
panel_3 = Panel(divide_curve_2.Points)

number_slider_2 = Slider(49.86, range=0..90)
number_slider_3 = Slider(0.69, range=0.05..1)
number_slider_4 = Slider(3, range=1..20)

# ---- group: Manipulação da lista de eixos de pilares
cull_index = CullIndex(List=line, Indices=number_slider, Wrap=True)
cull_index_2 = CullIndex(List=line, Indices="0", Wrap=True)

# ---- group: Eixos das aletas do brise
divide_curve_3 = DivideCurve(Curve=cull_index, Count=number_slider_4, Kinks=False)  # -> Points, Tangents, Parameters
divide_curve_4 = DivideCurve(Curve=cull_index_2, Count=number_slider_4, Kinks=False)  # -> Points, Tangents, Parameters
line_2 = Line(StartPoint=divide_curve_3.Points, EndPoint=divide_curve_4.Points)

# ---- group: zerando radiação difusa
xdata = LBDeconstructData(data=importepw.diffuse_horizontal_rad)  # -> header, values; plug-in component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
list_length = ListLength(List=xdata.values)
repeat_data = RepeatData(Data="0", Length=list_length)
data = LBConstructData(header=xdata.header, values=repeat_data)  # -> data; plug-in component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
panel_4 = Panel(data)

# ---- group: Criação das aletas
construct_plane = ConstructPlane(Origin=divide_curve_3.Points, XAxis=line_2, YAxis=divide_curve_3.Tangents)
deconstruct_plane = DeconstructPlane(Plane=construct_plane)  # -> Origin, XAxis, YAxis, ZAxis
construct_plane_2 = ConstructPlane(Origin=deconstruct_plane.Origin, XAxis=deconstruct_plane.ZAxis, YAxis=deconstruct_plane.YAxis)
cluster_retangulo_eixo = ClusterRetanguloEixo(plane=construct_plane_2, value=number_slider_2, dim_x=".03", dim=number_slider_3)
extrude_along = ExtrudeAlong(Base=cluster_retangulo_eixo, Curve=line_2)
cap_holes = CapHoles(Brep=extrude_along)

# ---- group: Ajustes / CONTEXT
brep = Brep([<brep referenced from the Rhino model> x3])

# ---- group: Ajustes
number_slider_5 = Slider(3, range=0.01..10)
lb_falsestarttoggle_2 = LBFalseStartToggle(True)
merge = Merge(Data1=brep, Data2=cap_holes)  # -> flatten(Result)

# ---- group: Ajustes / GEOMETRY
brep_2 = Brep(<brep referenced from the Rhino model>)

# ---- group: skydome direto
skymatrix = LBCumulativeSkyMatrix(location=importepw.location, direct_rad=importepw.direct_normal_rad, diffuse_rad=data)  # -> out, sky_mtx; plug-in component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
incidentradiation = LBIncidentRadiation(
    sky_mtx=skymatrix.sky_mtx,
    geometry=flatten(brep_2),
    context=flatten(merge),
    grid_size=number_slider_5,
    run=lb_falsestarttoggle_2)  # -> out, points, results, total, mesh, legend, title, int_mtx; plug-in component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

# ---- group: skydome total | direto e difuso
skymatrix_2 = LBCumulativeSkyMatrix(location=importepw.location, direct_rad=importepw.direct_normal_rad, diffuse_rad=importepw.diffuse_horizontal_rad)  # -> out, sky_mtx; plug-in component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
incidentradiation_2 = LBIncidentRadiation(
    sky_mtx=skymatrix_2.sky_mtx,
    geometry=flatten(brep_2),
    context=flatten(merge),
    grid_size=number_slider_5,
    run=lb_falsestarttoggle_2)  # -> out, points, results, total, mesh, legend, title, int_mtx; plug-in component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

# ----
multiplication = Multiplication(A="1000", B=incidentradiation.results)
multiplication_2 = Multiplication(A="1000", B=incidentradiation.total)
subtraction = Subtraction(A=incidentradiation_2.total, B=multiplication_2)
subtraction_2 = Subtraction(A=incidentradiation_2.results, B=multiplication)
heatmap = LBSpatialHeatmap(values=subtraction_2, mesh=incidentradiation.mesh)  # -> mesh, legend, title, colors, legend_par; plug-in component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
galapagos = Galapagos(fitness=subtraction, gene=[number_slider_4, number_slider_3, number_slider_2])
panel_5 = Panel(subtraction)

# ==== cluster ClusterRetanguloEixo
dim_x = ClusterInput()
plane = ClusterInput()
value = ClusterInput()
dim = ClusterInput()
negative = Negative(Value=value)
dim_x_2 = Number(dim_x)
dim_2 = Number(dim)
rotate_plane = RotatePlane(Plane=plane, Angle=degrees(negative))
division = Division(A=dim_2, B="2")
division_2 = Division(A=dim_x_2, B="2")
negative_2 = Negative(Value=division_2)
negative_3 = Negative(Value=division)
construct_domain = ConstructDomain(DomainStart=negative_3, DomainEnd=division)
construct_domain_2 = ConstructDomain(DomainStart=negative_2, DomainEnd=division_2)
rectangle = Rectangle(Plane=rotate_plane, XSize=construct_domain_2, YSize=construct_domain, Radius=0)  # -> Rectangle, Length
rectangle_2 = ClusterOutput(rectangle.Rectangle)
