# Grasshopper definition gra_temp_um_line.gh (Grasshopper 1.0.7)

ladybug = Ladybug_Ladybug()  # -> out; plug-in component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
panel = Panel("https://www.energyplus.net/weather-download/south_america_wmo_region_3/BRA//BRA_Salvador.832290_SWERA/all")
downloadepw = Ladybug_downloadEPWWeatherFile(download=Toggle(False))  # -> Output; plug-in component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
panel_2 = Panel(ladybug)
panel_3 = Panel(downloadepw)
epw_stat = Ladybug_OpenEPWAndSTATWeatherFiles(weatherFileURL=panel)  # -> epwFile, statFile; plug-in component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
importepw = Ladybug_ImportEpw(epwFile=epw_stat.epwFile)  # -> Output, latitude, location, dryBulbTemperature, dewPointTemperature, relativeHumidity, windSpeed, windDirection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; plug-in component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
explodelocation = Ladybug_DecomposeLocation(location=importepw.location)  # -> locationName, latitude, longitude, timeZone, elevation; plug-in component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
panel_4 = Panel(explodelocation.longitude)
panel_5 = Panel(explodelocation.timeZone)
panel_6 = Panel(explodelocation.latitude)
panel_7 = Panel(explodelocation.elevation)
panel_8 = Panel(explodelocation.locationName)
merge = Merge(Data1=importepw.dryBulbTemperature, Data2=importepw.relativeHumidity)
merge_2 = Merge(Data1=ColourSwatch(SwatchColor=RGB(255, 255, 0)), Data2=ColourSwatch(SwatchColor=RGB(0, 0, 255)))
panel_9 = Panel("""temperatura de bulbo seco
umidade relativa""")
legendpar = Ladybug_LegendParameters(customColors=flatten(merge_2))  # -> legendPar; plug-in component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
concatenate = Concatenate(Fragment_A="Comparação temperatura e umidade", A=explodelocation.locationName)
linechart = Ladybug_LineChart(
    inputData=flatten(merge),
    chartType=Slider(1, range=0..10),
    altTitle=concatenate,
    altYAxisTitle=panel_9,
    legendPar=legendpar)  # -> out, dataMesh, dataCurves, dataCrvColors, graphAxes, graphLabels, title, titleBasePt, legend, legendBasePt; plug-in component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
custom_preview = CustomPreview(Geometry=linechart.dataCurves, Material=linechart.dataCrvColors)
custom_preview_2 = CustomPreview(Geometry=linechart.graphAxes, Material=ColourSwatch(SwatchColor=RGB(0, 0, 0)))
