# Grasshopper definition heatMap.gh (Grasshopper 1.0.7)

ladybug = Ladybug_Ladybug()  # -> out; plug-in component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
panel = Panel("http://climate.onebuilding.org/WMO_Region_3_South_America/BRA_Brazil/SC_Santa_Catarina/BRA_SC_Chapeco.838830_TMYx.zip")
panel_2 = Panel("https://www.energyplus.net/weather-download/south_america_wmo_region_3/BRA//BRA_Salvador.832290_SWERA/all")
downloadepw = Ladybug_downloadEPWWeatherFile(download=Toggle(True))  # -> Output; plug-in component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
panel_3 = Panel(ladybug)
panel_4 = Panel(downloadepw)
epw_stat = Ladybug_OpenEPWAndSTATWeatherFiles(weatherFileURL=panel)  # -> epwFile, statFile; plug-in component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
epw_stat_2 = Ladybug_OpenEPWAndSTATWeatherFiles(weatherFileURL=panel_2)  # -> epwFile, statFile; plug-in component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
importepw = Ladybug_ImportEpw(epwFile=epw_stat.epwFile)  # -> Output, latitude, location, dryBulbTemperature, dewPointTemperature, relativeHumidity, windSpeed, windDirection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; plug-in component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
importepw_2 = Ladybug_ImportEpw(epwFile=epw_stat_2.epwFile)  # -> Output, latitude, location, dryBulbTemperature, dewPointTemperature, relativeHumidity, windSpeed, windDirection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; plug-in component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
strnum = Ladybug_SeparateData(inputList=flatten(importepw_2.dryBulbTemperature))  # -> numbers, strings; plug-in component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
strnum_2 = Ladybug_SeparateData(inputList=flatten(importepw.dryBulbTemperature))  # -> numbers, strings; plug-in component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
merge = Merge(Data1=strnum.numbers, Data2=strnum_2.numbers)
panel_5 = Panel(strnum.numbers)
sort_list = SortList(Keys=merge)  # -> Keys, ValuesValuesA
panel_6 = Panel(sort_list.Keys)
reverse_list = ReverseList(List=sort_list.Keys)
list_item = ListItem(List=sort_list.Keys, Index="0", Wrap=True)
list_item_2 = ListItem(List=reverse_list, Index="0", Wrap=True)
panel_7 = Panel(reverse_list)
panel_8 = Panel(list_item)
panel_9 = Panel(list_item_2)
legendpar = Ladybug_LegendParameters(lowBound=panel_8, highBound=panel_9)  # -> legendPar; plug-in component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
_3dchart = Ladybug_3DChart(
    inputData=flatten([importepw_2.dryBulbTemperature, importepw.dryBulbTemperature]),
    xScale="0.25",
    zScale="0",
    legendPar=legendpar)  # -> out, graphMesh, graphCurves, legend, legendBasePts, title, titleBasePts, dataPts, conditionalHOY; plug-in component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
