# Grasshopper definition heatMap_v2.gh (Grasshopper 1.0.7)

ladybug = Ladybug_Ladybug()  # -> out; plug-in component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
panel = Panel("http://climate.onebuilding.org/WMO_Region_3_South_America/BRA_Brazil/SC_Santa_Catarina/BRA_SC_Chapeco.838830_TMYx.zip")
panel_2 = Panel("https://www.energyplus.net/weather-download/south_america_wmo_region_3/BRA//BRA_Salvador.832290_SWERA/all")
downloadepw = Ladybug_downloadEPWWeatherFile(download=Toggle(True))  # -> Output; plug-in component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
panel_3 = Panel(ladybug)
panel_4 = Panel(downloadepw)
epw_stat = Ladybug_OpenEPWAndSTATWeatherFiles(weatherFileURL=panel)  # -> epwFile, statFile; plug-in component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
epw_stat_2 = Ladybug_OpenEPWAndSTATWeatherFiles(weatherFileURL=panel_2)  # -> epwFile, statFile; plug-in component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
importepw = Ladybug_ImportEpw(epwFile=epw_stat.epwFile)  # -> Output, latitude, location, dryBulbTemperature, dewPointTemperature, relativeHumidity, windSpeed, windDirection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; plug-in component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
importepw_2 = Ladybug_ImportEpw(epwFile=epw_stat_2.epwFile)  # -> Output, latitude, location, dryBulbTemperature, dewPointTemperature, relativeHumidity, windSpeed, windDirection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; plug-in component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
strnum = Ladybug_SeparateData(inputList=flatten(importepw.dryBulbTemperature))  # -> numbers, strings; plug-in component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
strnum_2 = Ladybug_SeparateData(inputList=flatten(importepw_2.dryBulbTemperature))  # -> numbers, strings; plug-in component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
panel_5 = Panel(strnum.numbers)
panel_6 = Panel(strnum_2.numbers)
sort_list = SortList(Keys=strnum.numbers)  # -> Keys, ValuesValuesA
sort_list_2 = SortList(Keys=strnum_2.numbers)  # -> Keys, ValuesA
reverse_list = ReverseList(List=sort_list.Keys)
reverse_list_2 = ReverseList(List=sort_list_2.Keys)
list_item = ListItem(List=sort_list.Keys, Index="0", Wrap=True)
panel_7 = Panel(sort_list.Keys)
list_item_2 = ListItem(List=reverse_list, Index="0", Wrap=True)
panel_8 = Panel(reverse_list)
list_item_3 = ListItem(List=sort_list_2.Keys, Index="0", Wrap=True)
panel_9 = Panel(sort_list_2.Keys)
panel_10 = Panel(reverse_list_2)
list_item_4 = ListItem(List=reverse_list_2, Index="0", Wrap=True)
panel_11 = Panel(list_item)
panel_12 = Panel(list_item_2)
panel_13 = Panel(list_item_3)
panel_14 = Panel(list_item_4)
minimum = Minimum(A=panel_13, B=panel_11)
maximum = Maximum(A=panel_14, B=panel_12)
panel_15 = Panel(minimum)
panel_16 = Panel(maximum)
legendpar = Ladybug_LegendParameters(lowBound=panel_15, highBound=panel_16)  # -> legendPar; plug-in component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
_3dchart = Ladybug_3DChart(
    inputData=flatten([importepw_2.dryBulbTemperature, importepw.dryBulbTemperature]),
    xScale="0.25",
    zScale="0",
    legendPar=legendpar)  # -> out, graphMesh, graphCurves, legend, legendBasePts, title, titleBasePts, dataPts, conditionalHOY; plug-in component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
