# Grasshopper definition rosaDosVentos.gh (Grasshopper 1.0.7)

ladybug = Ladybug_Ladybug()  # -> out; plug-in component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
panel = Panel("https://www.energyplus.net/weather-download/south_america_wmo_region_3/BRA//BRA_Salvador.832290_SWERA/all")
downloadepw = Ladybug_downloadEPWWeatherFile(download=Toggle(False))  # -> Output; plug-in component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
panel_2 = Panel(ladybug)
panel_3 = Panel(downloadepw)
epw_stat = Ladybug_OpenEPWAndSTATWeatherFiles(weatherFileURL=panel)  # -> epwFile, statFile; plug-in component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
importepw = Ladybug_ImportEpw(epwFile=epw_stat.epwFile)  # -> Output, latitude, location, dryBulbTemperature, dewPointTemperature, relativeHumidity, windSpeed, windDirection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; plug-in component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
analysisperiod = Ladybug_AnalysisPeriod(
    fromMonth=Slider(12, range=1..12),
    fromDay=Slider(21, range=1..31),
    toMonth=Slider(3, range=1..12),
    toDay=Slider(21, range=1..31))  # -> out, analysisPeriod; plug-in component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
panel_4 = Panel(analysisperiod.analysisPeriod)
windrose = Ladybug_WindRose(
    north=0,
    hourlyWindDirection=importepw.windDirection,
    hourlyWindSpeed=importepw.windSpeed,
    annualHourlyData=flatten(importepw.dryBulbTemperature),
    analysisPeriod=analysisperiod.analysisPeriod,
    runIt=Toggle(False))  # -> out, calmRoseMesh, windRoseMesh, windRoseCrvs, windRoseCenPts, legend, legendBasePts, title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; plug-in component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
custom_preview = CustomPreview(Geometry=windrose.windRoseCrvs, Material=ColourSwatch(SwatchColor=RGB(0, 0, 0)))
