# Grasshopper definition hb_energy_test_01.gh (Grasshopper 1.0.7)
# plug-ins: LadybugGrasshopper

# ---- group: volume da sala
rectangle = Rectangle(Plane=PlaneXY(0, 0, 0), XSize=Slider(26.12, range=0..100), YSize=Slider(26.8, range=0..100), Radius=0)  # -> Rectangle, Length
box_rectangle = BoxRectangle(Rectangle=rectangle.Rectangle, Height=Slider(5, range=0..5))

# ----
brep = Brep([<brep referenced from the Rhino model> x7])

# ---- group: EPW
lb_falsestarttoggle = LBFalseStartToggle(False)
panel = Panel("http://climate.onebuilding.org/WMO_Region_3_South_America/BRA_Brazil/BA_Bahia/BRA_BA_Salvador-Magalhaes.Intl.AP.832480_TMYx.zip")
epwmap = LBEPWmap(epw_map=lb_falsestarttoggle)  # -> Output; plug-in component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
downloadepw = LBDownloadWeather(weather_URL=panel)  # -> epw_file, stat_file, ddy_file; plug-in component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

# ----
intsolid = HBIntersectSolids(solids=flatten(brep), run=Toggle(True))  # -> int_solids; plug-in component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
lb_falsestarttoggle_2 = LBFalseStartToggle(False)
roomsolid = HBRoomFromSolid(geo=flatten(intsolid), conditioned=True)  # -> out, rooms; plug-in component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
lighting = HBLighting()  # -> lighting; plug-in component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
panel_2 = Panel("0")
solveadj = HBSolveAdjacency(rooms=flatten(roomsolid.rooms), air_boundary=Toggle(False), run=Toggle(True))  # -> out, adj_rooms; plug-in component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
annualloads = HBAnnualLoads(rooms=solveadj.adj_rooms, epw_file=downloadepw.epw_file, run=lb_falsestarttoggle_2)  # -> out, total_load, cooling, heating, lighting, equip, hot_water, balance; plug-in component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
panel_3 = Panel(annualloads.total_load)
aperturesbyratio = HBAperturesByRatio(hb_objs=flatten(solveadj.adj_rooms), ratio=Slider(0.35, range=0..1))  # -> out, hb_objs; plug-in component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
labelrooms = HBLabelRooms(rooms_model=flatten(roomsolid.rooms))  # -> label_text, base_pts, labels, wire_frame; plug-in component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
vizbytype = HBVisualizeByType(hb_objs=aperturesbyratio.hb_objs)  # -> walls, interior_walls, roofs, ceilings, exterior_floors, interior_floors, air_walls, apertures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; plug-in component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
custom_preview = CustomPreview(
    Geometry=vizbytype.walls,
    Material={diffuse=RGB(221, 160, 221), emission=RGB(66, 48, 66), shine=0.5, specular=RGB(255, 255, 255), transparency=0})
