# Grasshopper definition hb_radiance_teste.gh (Grasshopper 1.0.7)
# plug-ins: LadybugGrasshopper

# ---- group: volume da sala
rectangle = Rectangle(Plane=PlaneXY(0, 0, 0), XSize=Slider(26.12, range=0..100), YSize=Slider(26.8, range=0..100), Radius=0)  # -> Rectangle, Length
box_rectangle = BoxRectangle(Rectangle=rectangle.Rectangle, Height=Slider(5, range=0..5))

# ---- group: Modelo HB
roomsolid = HBRoomFromSolid(geo=flatten(box_rectangle), name="SALA_01", conditioned=True)  # -> out, rooms; plug-in component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
facparam = HBFacadeParameters(north=0, east=0, south=Slider(0.5, range=0..1), west=0)  # -> fac_par; plug-in component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
aperturesbyratio = HBAperturesByRatio(hb_objs=flatten(roomsolid.rooms), ratio=facparam, sill_height=Slider(1.46, range=0..2))  # -> out, hb_objs; plug-in component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
louvershades = HBLouverShades(
    hb_objs=flatten(aperturesbyratio.hb_objs),
    depth=Slider(0.82, range=0..1),
    shade_count=Slider(6, range=0..10),
    vertical=Toggle(False))  # -> readMe, hb_objs; plug-in component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
model = HBModel(rooms=flatten(louvershades.hb_objs))  # -> out, model; plug-in component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

# ----
vizbytype = HBVisualizeByType(hb_objs=louvershades.hb_objs)  # -> walls, interior_walls, roofs, ceilings, exterior_floors, interior_floors, air_walls, apertures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; plug-in component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
brep_wireframe = BrepWireframe(Brep=vizbytype.wire_frame, Density=-1)

# ---- group: Grid
facesbybc = HBFacesByBC(hb_objs=louvershades.hb_objs)  # -> outdoors, surface, ground, adiabatic, other; plug-in component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
vizbytype_2 = HBVisualizeByType(hb_objs=facesbybc.ground)  # -> walls, interior_walls, roofs, ceilings, exterior_floors, interior_floors, air_walls, apertures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; plug-in component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
surface = Surface(vizbytype_2.wire_frame)
negative = Negative(Value=Slider(0.7, range=0..1))
genpts = LBGeneratePointGrid(geometry=surface, grid_size=Slider(1, range=0..1), offset_dist=negative)  # -> points, vectors, face_areas, graft(mesh); plug-in component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
sensorgrid = HBSensorGrid(positions=genpts.points)  # -> grid; plug-in component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

# ---- group: weather data
lb_falsestarttoggle = LBFalseStartToggle(True)
panel = Panel("http://climate.onebuilding.org/WMO_Region_3_South_America/BRA_Brazil/BA_Bahia/BRA_BA_Salvador-Magalhaes.Intl.AP.832480_TMYx.zip")
epwmap = LBEPWmap(epw_map=lb_falsestarttoggle)  # -> Output; plug-in component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
downloadepw = LBDownloadWeather(weather_URL=panel)  # -> epw_file, stat_file, ddy_file; plug-in component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
wea = HBWeaFromEPW(epw_file=downloadepw.epw_file)  # -> wea; plug-in component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

# ----
assigngridsviews = HBAssignGridsAndViews(model=model.model, grids=flatten(sensorgrid))  # -> model; plug-in component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
lb_falsestarttoggle_2 = LBFalseStartToggle(False)
annualdaylight = HBAnnualDaylight(model=assigngridsviews, wea=wea, run=lb_falsestarttoggle_2)  # -> out, results, DA, cDA, UDI, UDI_low, UDI_up; plug-in component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
heatmap = LBSpatialHeatmap(values=annualdaylight.DA, mesh=genpts.mesh)  # -> mesh, legend, title, colors, legend_par; plug-in component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
