# Grasshopper definition hourly_chart.gh (Grasshopper 1.0.8)

panel = Panel("https://climate.onebuilding.org/WMO_Region_3_South_America/BRA_Brazil/BA_Bahia/BRA_BA_Salvador.866780_TMYx.zip")
panel_2 = Panel("https://climate.onebuilding.org/WMO_Region_4_North_and_Central_America/CAN_Canada/ON_Ontario/CAN_ON_Elliot.Lake.AP.717334_TMYx.zip")
downloadepw = LBDownloadWeather(weather_URL=panel)  # -> epw_file, stat_file, ddy_file; plug-in component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
epwmap = LBEPWmap(epw_map=Button())  # -> Output; plug-in component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
downloadepw_2 = LBDownloadWeather(weather_URL=panel_2)  # -> epw_file, stat_file, ddy_file; plug-in component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
importepw = LBImportEPW(epw_file=downloadepw.epw_file)  # -> location, dry_bulb_temperature, dew_point_temperature, relative_humidity, wind_speed, wind_direction, direct_normal_rad, diffuse_horizontal_rad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; plug-in component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
importepw_2 = LBImportEPW(epw_file=downloadepw_2.epw_file)  # -> location, dry_bulb_temperature, dew_point_temperature, relative_humidity, wind_speed, wind_direction, direct_normal_rad, diffuse_horizontal_rad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; plug-in component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
panel_3 = Panel(importepw.dry_bulb_temperature)
xdata = LBDeconstructData(data=importepw_2.dry_bulb_temperature)  # -> header, values; plug-in component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
xdata_2 = LBDeconstructData(data=importepw.dry_bulb_temperature)  # -> header, values; plug-in component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
panel_4 = Panel(xdata_2.header)
merge = Merge(Data1=xdata_2.values, Data2=xdata.values)
panel_5 = Panel(xdata_2.values)
sort_list = SortList(Keys=merge)  # -> Keys, ValuesValuesA
list_item = ListItem(List=sort_list.Keys, Index="0", Wrap=True)
list_item_2 = ListItem(List=sort_list.Keys, Index="-1", Wrap=True)
panel_6 = Panel(list_item_2)
legendpar = LBLegendParameters(min=list_item, max=list_item_2, seg_count=Slider(10, range=0..100))  # -> leg_par; plug-in component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
point = Point(Point(0, -139.1856575, -30))
hourlyplot = LBHourlyPlot(data=flatten(importepw.dry_bulb_temperature), legend_par=legendpar)  # -> out, mesh, legend, borders, labels, title, vis_set; plug-in component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
hourlyplot_2 = LBHourlyPlot(data=flatten(importepw_2.dry_bulb_temperature), base_pt=point, legend_par=legendpar)  # -> out, mesh, legend, borders, labels, title, vis_set; plug-in component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
