# Grasshopper definition hourly_chart_old.gh (Grasshopper 1.0.7)
# plug-ins: LadybugGrasshopper

panel = Panel("http://climate.onebuilding.org/WMO_Region_3_South_America/BRA_Brazil/BA_Bahia/BRA_BA_Salvador-Magalhaes.Intl.AP.832480_TMYx.zip")
lb_falsestarttoggle = LBFalseStartToggle(False)
panel_2 = Panel("http://climate.onebuilding.org/WMO_Region_3_South_America/BRA_Brazil/SC_Santa_Catarina/BRA_SC_Chapeco.838830_TMYx.zip")
lb_falsestarttoggle_2 = LBFalseStartToggle(False)
epwmap = LBEPWmap(epw_map=lb_falsestarttoggle)  # -> Output; plug-in component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
epwmap_2 = LBEPWmap(epw_map=lb_falsestarttoggle_2)  # -> Output; plug-in component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
downloadepw = LBDownloadWeather(weather_URL=panel)  # -> epw_file, stat_file, ddy_file; plug-in component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
downloadepw_2 = LBDownloadWeather(weather_URL=panel_2)  # -> epw_file, stat_file, ddy_file; plug-in component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
importepw = LBImportEPW(epw_file=downloadepw.epw_file)  # -> location, dry_bulb_temperature, dew_point_temperature, relative_humidity, wind_speed, wind_direction, direct_normal_rad, diffuse_horizontal_rad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; plug-in component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
importepw_2 = LBImportEPW(epw_file=downloadepw_2.epw_file)  # -> location, dry_bulb_temperature, dew_point_temperature, relative_humidity, wind_speed, wind_direction, direct_normal_rad, diffuse_horizontal_rad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; plug-in component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
data = Data(importepw.dry_bulb_temperature)
data_2 = Data(importepw_2.dry_bulb_temperature)
panel_3 = Panel(data_2)
xdata = LBDeconstructData(data=data)  # -> header, values; plug-in component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
panel_4 = Panel(data)
xdata_2 = LBDeconstructData(data=data_2)  # -> header, values; plug-in component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
bounds = Bounds(Numbers=xdata.values)
bounds_2 = Bounds(Numbers=xdata_2.values)
deconstruct_domain = DeconstructDomain(Domain=bounds)  # -> Start, End
deconstruct_domain_2 = DeconstructDomain(Domain=bounds_2)  # -> Start, End
colrange = LBColorRange(index=Slider(0, range=0..25))  # -> colors; plug-in component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
minimum = Minimum(A=deconstruct_domain.Start, B=deconstruct_domain_2.Start)
maximum = Maximum(A=deconstruct_domain.End, B=deconstruct_domain_2.End)
legendpar = LBLegendParameters(min=minimum, max=maximum, colors=colrange, vert_or_horiz=Toggle(True))  # -> leg_par; plug-in component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
lb_falsestarttoggle_3 = LBFalseStartToggle(True)
point = Point(Point(0, 150, 0))
syncghfile = LBSyncGrasshopperFile(sync=lb_falsestarttoggle_3)  # -> report; plug-in component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
hourlyplot = LBHourlyPlot(data=data, legend_par=legendpar)  # -> report, mesh, legend, borders, labels, title, vis_set; plug-in component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
hourlyplot_2 = LBHourlyPlot(data=data_2, base_pt=point, legend_par=legendpar)  # -> report, mesh, legend, borders, labels, title, vis_set; plug-in component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
