# Grasshopper definition PMV_ADAP_COM.gh (Grasshopper 1.0.8)
# plug-ins: LadybugGrasshopper

lb_falsestarttoggle = LBFalseStartToggle(False)
number_slider = Slider(21, range=0..30)
lb_falsestarttoggle_2 = LBFalseStartToggle(False)
adaptive = LBAdaptiveComfort(out_temp=Slider(21, range=0..30), air_temp=number_slider, run=lb_falsestarttoggle_2)  # -> out, prevail_temp, neutral_temp, deg_neutral, comfort, condition, comf_obj; plug-in component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
pmv = LBPMVComfort(air_temp=number_slider, rel_humid=Slider(57, range=10..80), run=lb_falsestarttoggle)  # -> out, pmv, ppd, set, comfort, condition, heat_loss, comf_obj; plug-in component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
panel = Panel(pmv.pmv)
panel_2 = Panel(adaptive.neutral_temp)
# https://comfort.cbe.berkeley.edu/
panel_3 = Panel(adaptive.prevail_temp)
panel_4 = Panel(adaptive.comfort)
panel_5 = Panel(adaptive.condition)
