# Grasshopper definition inferface_básica_final_1_3_0.gh (Grasshopper 1.0.7)

number_slider = Slider(1, range=0..20)
utci = LBUTCIComfort(air_temp=Slider(23, range=-20..80), rel_humid=Slider(57.2, range=0..100), run=Toggle(True))  # -> out, utci, comfort, condition, category, comf_obj; plug-in component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
legendpar = LBLegendParameters(min="0", max="50", seg_count=Slider(14, range=0..20), vert_or_horiz=Toggle(False), seg_height=Slider(1, range=0..10))  # -> leg_par; plug-in component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
mesh_plane = MeshPlane(
    Boundary={Plane=PlaneXY(0, 0, 0), Size=Domain2(u=-10..10, v=-10..10)},
    WidthCount=Slider(1, range=1..10),
    HeightCount=Slider(1, range=1..10))  # -> Mesh, Area
heatmap = LBSpatialHeatmap(values=flatten(utci.utci), mesh=mesh_plane.Mesh, legend_par=legendpar)  # -> mesh, legend, title, colors, legend_par; plug-in component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
