# Grasshopper definition utci.gh (Grasshopper 1.0.8)

series = Series(Start=0, Step=1, Count=10)
number_slider = Slider(1, range=0..20)
legendpar = LBLegendParameters(min="0", max="50", seg_count=Slider(14, range=0..20), vert_or_horiz=Toggle(False), seg_height=Slider(1, range=0..10))  # -> leg_par; plug-in component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
mesh_plane = MeshPlane(
    Boundary={Plane=PlaneXY(0, 0, 0), Size=Domain2(u=-10..10, v=-10..10)},
    WidthCount=Slider(1, range=1..10),
    HeightCount=Slider(1, range=1..10))  # -> Mesh, Area
utci = LBUTCIComfort(air_temp=Slider(23, range=-20..80), rel_humid=Slider(57.2, range=0..100), run=Toggle(True))  # -> report, utci, comfort, condition, category, comf_obj; plug-in component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
heatmap = LBSpatialHeatmap(values=utci.utci, mesh=mesh_plane.Mesh, legend_par=legendpar)  # -> mesh, legend, title, colors, legend_par, vis_set; plug-in component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
