# Grasshopper definition archicad_connect.gh (Grasshopper 1.0.7)
# plug-ins: Grasshopper-ARCHICAD Live Connection built for Rhinoceros 6

series = Series(Start="0.00", Step=Slider(3, range=0.01..10), Count=Slider(3, range=1..50))
xy_plane = XYPlane(Origin=Point(0, 0, 0))
unit_z = UnitZ(Factor=series)
move = Move(Geometry=xy_plane, Motion=unit_z)  # -> Geometry, Transform
layer = Layer()
story_plane = StoryPlane()
number_slider = Slider(10, range=1..50)
slabsetc = SlabSettingsComposite(Layer=layer, HomeStory=story_plane, Layer_2=layer, HomeStory_2=story_plane, AC_ActiveState_Name="Composite")
rectangle = Rectangle(Plane=move.Geometry, XSize=number_slider, YSize=number_slider, Radius=0)  # -> Rectangle, Length
panel = Panel(slabsetc)
slab = Slab(Synchronize=Toggle(True), Polygon=rectangle.Rectangle, SlabSettings=slabsetc)
panel_2 = Panel(slab)
