# Grasshopper definition rhino_inside.gh (Grasshopper 1.0.7)
# plug-ins: Rhino.Inside for Autodesk Revit

active_document = ActiveDocument()
panel = Panel(active_document)
polygon = Polygon(Plane=PlaneXY(0, 0, 0), Radius=Slider(10, range=10..100), Segments=6, FilletRadius=0)  # -> Polygon, Length
type = Type(<hostobjecttype referenced from the Revit model>)
level = Level(<level referenced from the Revit model>)
add_floor = AddFloor(Boundary=polygon.Polygon, Type=type, Level=level, Structural=Toggle(False))
add_geometry_directshape = AddGeometryDirectShape(Name="teste", Geometry=polygon.Polygon)
