# Grasshopper definition teste_grevit.gh (Grasshopper 1.0.7)
# plug-ins: Grevit.GrassHopper

number_slider = Slider(7, range=0..20)
series = Series(Start="0.00", Step=Slider(3, range=0.1..10), Count=number_slider)
plane_surface = PlaneSurface(Plane=PlaneXY(0, 0, 0), XSize=Slider(47, range=0..100), YSize=Domain(-10, 10))
unit_z = UnitZ(Factor=series)
concatenate = Concatenate(Fragment_A="Pav.", Fragment_B=" ", A=series)
duplicate_data = DuplicateData(Data=Toggle(True), Number=number_slider, Order=True)
move = Move(Geometry=plane_surface, Motion=unit_z)  # -> Geometry, Transform
grevit_revit_slab = GrevitRevitSlab(Surface=move.Geometry, Type="Concreto-comercial 362 mm", Levelbottom=concatenate)
grevit_revit_level = GrevitRevitLevel(Name=concatenate, Elevation=series, View=duplicate_data)
panel = Panel(concatenate)
merge = Merge(Data1=grevit_revit_level, Data2=grevit_revit_slab)
power = Power(A="10", B=Slider(6, range=1..20))
grevit_id = GrevitID(GrevitComponent=grevit_revit_level)
grevit_send = GrevitSend(
    Components=flatten(merge),
    Send=Button(),
    IP="127.0.0.1",
    Port="8002",
    Update=Toggle(True),
    Scale=Slider(1, range=1..1000))
panel_2 = Panel(grevit_id)
panel_3 = Panel(grevit_send)
