# Grasshopper definition ladybug_02.gh (Grasshopper 1.0.7)

ladybug = Ladybug_Ladybug()  # -> out; plug-in component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
panel = Panel("https://www.energyplus.net/weather-download/south_america_wmo_region_3/BRA//BRA_Salvador.832290_SWERA/all")
panel_2 = Panel("http://climate.onebuilding.org/WMO_Region_4_North_and_Central_America/CAN_Canada/NT_Northwest_Territories/CAN_NT_Yellowknife.AP.719360_CWEC.zip")
downloadepw = Ladybug_downloadEPWWeatherFile(download=Toggle(False))  # -> Output; plug-in component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
panel_3 = Panel(ladybug)
panel_4 = Panel(downloadepw)
epw_stat = Ladybug_OpenEPWAndSTATWeatherFiles(weatherFileURL=panel)  # -> epwFile, statFile; plug-in component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
epw_stat_2 = Ladybug_OpenEPWAndSTATWeatherFiles(weatherFileURL=panel_2)  # -> epwFile, statFile; plug-in component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
importepw = Ladybug_ImportEpw(epwFile=epw_stat.epwFile)  # -> Output, latitude, location, dryBulbTemperature, dewPointTemperature, relativeHumidity, windSpeed, windDirection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; plug-in component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
importepw_2 = Ladybug_ImportEpw(epwFile=epw_stat_2.epwFile)  # -> Output, latitude, location, dryBulbTemperature, dewPointTemperature, relativeHumidity, windSpeed, windDirection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; plug-in component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
strnum = Ladybug_SeparateData(inputList=flatten([importepw_2.dryBulbTemperature, importepw.dryBulbTemperature]))  # -> flatten(numbers), strings; plug-in component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
strnum_2 = Ladybug_SeparateData(inputList=flatten([importepw.dryBulbTemperature, importepw_2.dryBulbTemperature]))  # -> flatten(numbers), strings; plug-in component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
sort_list = SortList(Keys=strnum_2.numbers)  # -> reverse(Keys), ValuesA
sort_list_2 = SortList(Keys=strnum.numbers)  # -> Keys, ValuesValuesA
list_item = ListItem(List=sort_list_2.Keys, Index=0, Wrap=True)
list_item_2 = ListItem(List=sort_list.Keys, Index=0, Wrap=True)
panel_5 = Panel(list_item_2)
legendpar = Ladybug_LegendParameters(lowBound=list_item, highBound=list_item_2)  # -> legendPar; plug-in component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
_3dchart = Ladybug_3DChart(
    inputData=flatten([importepw.dryBulbTemperature, importepw_2.dryBulbTemperature]),
    xScale="0.25",
    zScale="0",
    legendPar=legendpar)  # -> out, graphMesh, graphCurves, legend, legendBasePts, title, titleBasePts, dataPts, conditionalHOY; plug-in component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
panel_6 = Panel(sort_list.Keys)
