# Grasshopper definition month_chart.gh (Grasshopper 1.0.7)
# plug-ins: LadybugGrasshopper

panel = Panel("http://climate.onebuilding.org/WMO_Region_3_South_America/BRA_Brazil/BA_Bahia/BRA_BA_Salvador-Magalhaes.Intl.AP.832480_TMYx.zip")
lb_falsestarttoggle = LBFalseStartToggle(False)
epwmap = LBEPWmap(epw_map=lb_falsestarttoggle)  # -> Output; plug-in component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
downloadepw = LBDownloadWeather(weather_URL=panel)  # -> epw_file, stat_file, ddy_file; plug-in component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
importepw = LBImportEPW(epw_file=downloadepw.epw_file)  # -> location, dry_bulb_temperature, dew_point_temperature, relative_humidity, wind_speed, wind_direction, direct_normal_rad, diffuse_horizontal_rad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; plug-in component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
panel_2 = Panel("total")
legendpar = LBLegendParameters(min="0")  # -> leg_par; plug-in component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
timeop = LBTimeIntervalOperation(data=importepw.dry_bulb_temperature, operation="average")  # -> daily, monthly, mon_per_hr; plug-in component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
xdata = LBDeconstructData(data=timeop.monthly)  # -> header, values; plug-in component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
panel_3 = Panel(timeop.monthly)
monthlychart = LBMonthlyChart(data=timeop.monthly, y_dim=Slider(49, range=0..100), legend_par=legendpar)  # -> report, data_mesh, data_lines, col_lines, legend, borders, labels, y_title, title, vis_set; plug-in component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
panel_4 = Panel(xdata.values)
