# Grasshopper definition SKYDOME.gh (Grasshopper 1.0.7)
# plug-ins: LadybugGrasshopper

# ---- group: Norte
curve = Curve(<curve referenced from the Rhino model>)
end_points = EndPoints(Curve=curve)  # -> Start, End
xy_plane = XYPlane(Origin=Point(0, 0, 0))
vector_2pt = Vector2Pt(PointA=end_points.Start, PointB=end_points.End, Unitize=False)  # -> Vector, Length
unit_y = UnitY(Factor=1)
angle = Angle(VectorA=unit_y, VectorB=vector_2pt.Vector, Plane=xy_plane)  # -> Angle, Reflex
degrees = Degrees(Radians=angle.Angle)
compass = LBCompass(north=degrees, center=end_points.Start)  # -> compass; plug-in component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

# ----
number_slider = Slider(1, range=1..12)
number_slider_2 = Slider(12, range=1..12)

# ---- group: EPW
panel = Panel("http://climate.onebuilding.org/WMO_Region_3_South_America/BRA_Brazil/BA_Bahia/BRA_BA_Salvador-Magalhaes.Intl.AP.832480_TMYx.zip")
lb_falsestarttoggle = LBFalseStartToggle(False)
epwmap = LBEPWmap(epw_map=lb_falsestarttoggle)  # -> Output; plug-in component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
downloadepw = LBDownloadWeather(weather_URL=panel)  # -> epw_file, stat_file, ddy_file; plug-in component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
importepw = LBImportEPW(epw_file=downloadepw.epw_file)  # -> location, dry_bulb_temperature, dew_point_temperature, relative_humidity, wind_speed, wind_direction, direct_normal_rad, diffuse_horizontal_rad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; plug-in component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

# ----
number_slider_3 = Slider(21, range=1..31)
multiplication = Multiplication(A=Slider(2, range=1..4), B="3")
panel_2 = Panel(multiplication)
analysisperiod = LBAnalysisPeriod(start_month=multiplication, start_day=number_slider_3, start_hour=0, end_month=multiplication, end_day=number_slider_3)  # -> period, hoys, dates; plug-in component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
list_length = ListLength(List=analysisperiod.hoys)
panel_3 = Panel(analysisperiod.period)
panel_4 = Panel(list_length)

# ---- group: skydome
value_list = ValueList({"ORTHOGRAPHIC", "STEREOGRAPHIC", "3D": NULL}, selected="3D")
skymatrix = LBCumulativeSkyMatrix(
    north=degrees,
    location=importepw.location,
    direct_rad=importepw.direct_normal_rad,
    diffuse_rad=importepw.diffuse_horizontal_rad,
    high_density=Toggle(False))  # -> out, sky_mtx; plug-in component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
skydome = LBSkyDome(sky_mtx=skymatrix.sky_mtx, projection=value_list, show_comp=Toggle(True))  # -> report, mesh, compass, legend, title, patch_vecs, patch_values, mesh_values, vis_set; plug-in component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

# ----
panel_5 = Panel(degrees)
param_viewer = ParamViewer(skydome.patch_values)
tree_branch = TreeBranch(Tree=simplify(skydome.patch_values), Path=Slider(0, range=0..2), MaintainPaths=True)
bounds = Bounds(Numbers=tree_branch)
panel_6 = Panel(param_viewer)
panel_7 = Panel(tree_branch)
panel_8 = Panel(bounds)
