# Grasshopper definition SKYDOME_CREATE_COMPOMNENTS.gh (Grasshopper 1.0.7)
# plug-ins: LadybugGrasshopper

# ---- group: EPW
panel = Panel("http://climate.onebuilding.org/WMO_Region_3_South_America/BRA_Brazil/BA_Bahia/BRA_BA_Salvador-Magalhaes.Intl.AP.832480_TMYx.zip")
lb_falsestarttoggle = LBFalseStartToggle(False)
epwmap = LBEPWmap(epw_map=lb_falsestarttoggle)  # -> Output; plug-in component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
downloadepw = LBDownloadWeather(weather_URL=panel)  # -> epw_file, stat_file, ddy_file; plug-in component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
file_path = FilePath("C:\ladybug\BRA_BA_Salvador-Magalhaes.Intl.AP.832480_TMYx\BRA_BA_Salvador-Magalhaes.Intl.AP.832480_TMYx.epw")
importepw = LBImportEPW(epw_file=file_path)  # -> location, dry_bulb_temperature, dew_point_temperature, relative_humidity, wind_speed, wind_direction, direct_normal_rad, diffuse_horizontal_rad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; plug-in component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

# ---- group: zerando radiação difusa
xdata = LBDeconstructData(data=importepw.diffuse_horizontal_rad)  # -> header, values; plug-in component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
list_length = ListLength(List=xdata.values)
repeat_data = RepeatData(Data="0", Length=list_length)
data = LBConstructData(header=xdata.header, values=repeat_data)  # -> data; plug-in component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
panel_2 = Panel(data)

# ----
panel_3 = Panel(importepw.diffuse_horizontal_rad)

# ---- group: AJUSTES DO SKYDOME
legendpar = LBLegendParameters(min="0", max=Slider(60, range=0..100))  # -> leg_par; plug-in component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
value_list = ValueList({"ORTHOGRAPHIC", "STEREOGRAPHIC", "3D": NULL}, selected="STEREOGRAPHIC")
boolean_toggle = BooleanToggle(False)

# ---- group: skydome direto
skymatrix = LBCumulativeSkyMatrix(location=importepw.location, direct_rad=importepw.direct_normal_rad, diffuse_rad=data, high_density=boolean_toggle)  # -> out, sky_mtx; plug-in component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
point = Point(Point(302.7730911, 317.9064218, 0))
panel_4 = Panel(skymatrix.sky_mtx)
skydome = LBSkyDome(sky_mtx=skymatrix.sky_mtx, center_pt=point, projection=value_list, show_comp=Toggle(False), legend_par=legendpar)  # -> out, mesh, compass, legend, title, patch_vecs, patch_values, mesh_values; plug-in component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

# ---- group: skydome total | direto e difuso
skymatrix_2 = LBCumulativeSkyMatrix(
    location=importepw.location,
    direct_rad=importepw.direct_normal_rad,
    diffuse_rad=importepw.diffuse_horizontal_rad,
    high_density=boolean_toggle)  # -> out, sky_mtx; plug-in component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
skydome_2 = LBSkyDome(sky_mtx=skymatrix_2.sky_mtx, projection=value_list, show_comp=Toggle(True), legend_par=legendpar)  # -> out, mesh, compass, legend, title, patch_vecs, patch_values, mesh_values; plug-in component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

# ----
param_viewer = ParamViewer(skydome.patch_values)

# ---- group: branches skydome
param_viewer_2 = ParamViewer(skydome_2.patch_values)
tree_branch = TreeBranch(Tree=simplify(skydome_2.patch_values), Path=Slider(2, range=0..2), MaintainPaths=True)
tree_branch_2 = TreeBranch(Tree=simplify(skydome_2.patch_values), Path=Slider(0, range=0..2), MaintainPaths=True)
bounds = Bounds(Numbers=tree_branch_2)
panel_5 = Panel(tree_branch)
panel_6 = Panel(bounds)
panel_7 = Panel(tree_branch_2)

# ----
tree_branch_3 = TreeBranch(Tree=simplify(skydome_2.mesh_values), Path=Slider(0, range=0..2), MaintainPaths=True)
panel_8 = Panel(skydome.patch_values)
bounds_2 = Bounds(Numbers=tree_branch_3)

# ---- group: RECRIANDO SKYMATRIX DIFFUSE
unit_x = UnitX(Factor=Slider(300, range=0..1000))
subtraction = Subtraction(A=tree_branch_3, B=skydome.mesh_values)
move = Move(Geometry=skydome.mesh, Motion=unit_x)  # -> Geometry, Transform
move_2 = Move(Geometry=skydome.compass, Motion=unit_x)  # -> Geometry, Transform
panel_9 = Panel(move.Geometry)
panel_10 = Panel(subtraction)
heatmap = LBSpatialHeatmap(values=subtraction, mesh=move.Geometry, legend_par=legendpar, legend_title="kW/m2")  # -> mesh, legend, title, colors, legend_par; plug-in component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

# ----
panel_11 = Panel(bounds_2)
