# Grasshopper definition SKYDOME_teste.gh (Grasshopper 1.0.7)
# plug-ins: LadybugGrasshopper

panel = Panel("http://climate.onebuilding.org/WMO_Region_3_South_America/BRA_Brazil/BA_Bahia/BRA_BA_Salvador-Magalhaes.Intl.AP.832480_TMYx.zip")
lb_falsestarttoggle = LBFalseStartToggle(True)
epwmap = LBEPWmap(epw_map=lb_falsestarttoggle)  # -> Output; plug-in component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
downloadepw = LBDownloadWeather(weather_URL=panel)  # -> epw_file, stat_file, ddy_file; plug-in component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
file_path = FilePath("C:\ladybug\BRA_BA_Salvador-Magalhaes.Intl.AP.832480_TMYx\BRA_BA_Salvador-Magalhaes.Intl.AP.832480_TMYx.epw")
importepw = LBImportEPW(epw_file=file_path)  # -> location, dry_bulb_temperature, dew_point_temperature, relative_humidity, wind_speed, wind_direction, direct_normal_rad, diffuse_horizontal_rad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; plug-in component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
curve = Curve(<curve referenced from the Rhino model>)
end_points = EndPoints(Curve=curve)  # -> Start, End
panel_2 = Panel(importepw.direct_normal_rad)
unit_y = UnitY(Factor=1)
vector_2pt = Vector2Pt(PointA=end_points.Start, PointB=end_points.End, Unitize=False)  # -> Vector, Length
xy_plane = XYPlane(Origin=Point(0, 0, 0))
xdata = LBDeconstructData(data=importepw.diffuse_horizontal_rad)  # -> header, values; plug-in component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
angle = Angle(VectorA=unit_y, VectorB=vector_2pt.Vector, Plane=xy_plane)  # -> Angle, Reflex
list_length = ListLength(List=xdata.values)
value_list = ValueList({"ORTHOGRAPHIC", "STEREOGRAPHIC", "3D": NULL}, selected="STEREOGRAPHIC")
value_list_2 = ValueList({"ORTHOGRAPHIC", "STEREOGRAPHIC", "3D": NULL}, selected="STEREOGRAPHIC")
degrees = Degrees(Radians=angle.Angle)
skymatrix = LBCumulativeSkyMatrix(
    north=degrees,
    location=importepw.location,
    direct_rad=importepw.direct_normal_rad,
    diffuse_rad=importepw.diffuse_horizontal_rad,
    high_density=Toggle(False))  # -> out, sky_mtx; plug-in component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
duplicate_data = DuplicateData(Data="0", Number=list_length, Order=True)
data = LBConstructData(header=xdata.header, values=duplicate_data)  # -> data; plug-in component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
skymatrix_2 = LBCumulativeSkyMatrix(
    north=degrees,
    location=importepw.location,
    direct_rad=importepw.direct_normal_rad,
    diffuse_rad=data,
    high_density=Toggle(False))  # -> out, sky_mtx; plug-in component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
point = Point(Point(2.900426545, 319.2940171, 0))
skydome = LBSkyDome(sky_mtx=skymatrix_2.sky_mtx, center_pt=point, projection=value_list, show_comp=Toggle(False))  # -> out, mesh, compass, legend, title, patch_vecs, patch_values, mesh_values; plug-in component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
skydome_2 = LBSkyDome(sky_mtx=skymatrix.sky_mtx, projection=value_list_2, show_comp=Toggle(True))  # -> out, mesh, compass, legend, title, patch_vecs, patch_values, mesh_values; plug-in component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
panel_3 = Panel(skymatrix_2.sky_mtx)
compass = LBCompass(north=degrees, center=end_points.Start)  # -> compass; plug-in component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
panel_4 = Panel(degrees)
panel_5 = Panel(data)
param_viewer = ParamViewer(skydome.patch_values)
tree_branch = TreeBranch(Tree=simplify(skydome.mesh_values), Path=Slider(0, range=0..2), MaintainPaths=True)
param_viewer_2 = ParamViewer(skydome_2.patch_values)
tree_branch_2 = TreeBranch(Tree=simplify(skydome_2.patch_values), Path=Slider(0, range=0..2), MaintainPaths=True)
tree_branch_3 = TreeBranch(Tree=simplify(skydome_2.patch_values), Path=Slider(2, range=0..2), MaintainPaths=True)
bounds = Bounds(Numbers=tree_branch)
subtraction = Subtraction(A=tree_branch_2, B=skydome.patch_values)
bounds_2 = Bounds(Numbers=tree_branch_2)
panel_6 = Panel(subtraction)
panel_7 = Panel(skydome.patch_values)
panel_8 = Panel(bounds)
panel_9 = Panel(tree_branch_3)
panel_10 = Panel(bounds_2)
panel_11 = Panel(tree_branch)
panel_12 = Panel(tree_branch_2)
