# Grasshopper definition rad_surfaces.gh (Grasshopper 1.0.7)
# plug-ins: LadybugGrasshopper

# ---- group: Norte
curve = Curve(<curve referenced from the Rhino model>)
end_points = EndPoints(Curve=curve)  # -> Start, End
xy_plane = XYPlane(Origin=Point(0, 0, 0))
vector_2pt = Vector2Pt(PointA=end_points.Start, PointB=end_points.End, Unitize=False)  # -> Vector, Length
unit_y = UnitY(Factor=1)
angle = Angle(VectorA=unit_y, VectorB=vector_2pt.Vector, Plane=xy_plane)  # -> Angle, Reflex
degrees = Degrees(Radians=angle.Angle)
compass = LBCompass(north=degrees, center=end_points.Start)  # -> compass; plug-in component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

# ---- group: EPW
panel = Panel("http://climate.onebuilding.org/WMO_Region_3_South_America/BRA_Brazil/BA_Bahia/BRA_BA_Salvador-Magalhaes.Intl.AP.832480_TMYx.zip")
lb_falsestarttoggle = LBFalseStartToggle(False)
epwmap = LBEPWmap(epw_map=lb_falsestarttoggle)  # -> Output; plug-in component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
downloadepw = LBDownloadWeather(weather_URL=panel)  # -> epw_file, stat_file, ddy_file; plug-in component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
importepw = LBImportEPW(epw_file=downloadepw.epw_file)  # -> location, dry_bulb_temperature, dew_point_temperature, relative_humidity, wind_speed, wind_direction, direct_normal_rad, diffuse_horizontal_rad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; plug-in component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

# ---- group: skydome
skymatrix = LBCumulativeSkyMatrix(
    north=degrees,
    location=importepw.location,
    direct_rad=importepw.direct_normal_rad,
    diffuse_rad=importepw.diffuse_horizontal_rad,
    high_density=Toggle(False))  # -> out, sky_mtx; plug-in component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

# ----
geometria = Brep(<brep referenced from the Rhino model>)
contexto = Brep([<brep referenced from the Rhino model> x2])
lb_falsestarttoggle_2 = LBFalseStartToggle(False)
panel_2 = Panel(degrees)
incidentradiation = LBIncidentRadiation(
    sky_mtx=skymatrix.sky_mtx,
    geometry=flatten(geometria),
    context=flatten(contexto),
    grid_size=Slider(5, range=0.01..10),
    run=lb_falsestarttoggle_2)  # -> report, points, results, total, mesh, legend, title, int_mtx; plug-in component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
