# Grasshopper definition radiation_03.gh (Grasshopper 1.0.7)

panel = Panel("https://www.energyplus.net/weather-download/south_america_wmo_region_3/BRA//BRA_Salvador.832290_SWERA/all")
ladybug = Ladybug_Ladybug()  # -> out; plug-in component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
downloadepw = Ladybug_downloadEPWWeatherFile(download=Toggle(False))  # -> Output; plug-in component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
panel_2 = Panel(ladybug)
epw_stat = Ladybug_OpenEPWAndSTATWeatherFiles(weatherFileURL=panel)  # -> epwFile, statFile; plug-in component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
panel_3 = Panel(downloadepw)
gencumulativeskymtx = Ladybug_GenCumulativeSkyMtx(epwFile=epw_stat.epwFile, skyDensity=0, useOldRes=True, runIt=Toggle(True))  # -> out, cumulativeSkyMtx; plug-in component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
selectskymtx = Ladybug_selectSkyMtx(cumulativeSkyMtx=gencumulativeskymtx.cumulativeSkyMtx, removeDiffuse=False, removeDirect=False)  # -> out, selectedSkyMtx; plug-in component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
radiationrose = Ladybug_RadiationRose(selectedSkyMtx=selectskymtx.selectedSkyMtx, arrowHeadScale=1, runIt=Toggle(True))  # -> out, radiationArrowsMesh, radRoseBaseCrvs, legend, legendBasePts, radRoseEndPts, radRoseValues; plug-in component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
