# Grasshopper definition radiation_04_teste.gh (Grasshopper 1.0.7)

panel = Panel("https://www.energyplus.net/weather-download/south_america_wmo_region_3/BRA//BRA_Salvador.832290_SWERA/all")
ladybug = Ladybug_Ladybug()  # -> out; plug-in component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
downloadepw = Ladybug_downloadEPWWeatherFile(download=Toggle(False))  # -> Output; plug-in component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
panel_2 = Panel(ladybug)
number_slider = Slider(360, range=0..360)
number_slider_2 = Slider(20, range=1..180)
epw_stat = Ladybug_OpenEPWAndSTATWeatherFiles(weatherFileURL=panel)  # -> epwFile, statFile; plug-in component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
boolean_toggle = BooleanToggle(False)
panel_3 = Panel(downloadepw)
point = Point(Point(0, 0, 0))
gencumulativeskymtx = Ladybug_GenCumulativeSkyMtx(epwFile=epw_stat.epwFile, skyDensity=0, useOldRes=True, runIt=Toggle(True))  # -> out, cumulativeSkyMtx; plug-in component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

# ---- group: Norte
curve = Curve(<curve referenced from the Rhino model>)
end_points = EndPoints(Curve=curve)  # -> Start, End
vector_2pt = Vector2Pt(PointA=end_points.Start, PointB=end_points.End, Unitize=False)  # -> Vector, Length
northarrow = Ladybug_North(north=vector_2pt.Vector, centerPt=end_points.Start, scale=Slider(4, range=0.001..10))  # -> northSign; plug-in component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

# ----
selectskymtx = Ladybug_selectSkyMtx(cumulativeSkyMtx=gencumulativeskymtx.cumulativeSkyMtx, removeDiffuse=False, removeDirect=False)  # -> out, selectedSkyMtx; plug-in component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
orientationstudypar = Ladybug_OrientationStudyParameters(divisionAngle=number_slider_2, totalAngle=number_slider, basePoint=point, runTheStudy=boolean_toggle)  # -> orientationStudyPar; plug-in component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
division = Division(A=number_slider, B=number_slider_2)

# ---- group: Geometria
brep = Brep(<brep referenced from the Rhino model>)

# ---- group: Contexto
brep_2 = Brep([<brep referenced from the Rhino model> x2])

# ----
addition = Addition(A=division, B="1")
series = Series(Start="0", Step=number_slider_2, Count=addition)
radiationanalysis = Ladybug_RadiationAnalysis(
    north=vector_2pt.Vector,
    geometry=flatten(brep),
    context=flatten(brep_2),
    gridSize=Slider(5, range=1..100),
    disFromBase=Slider(0.01, range=0.01..2),
    orientationStudyP=flatten(orientationstudypar),
    selectedSkyMtx=flatten(selectskymtx.selectedSkyMtx),
    runIt=boolean_toggle)  # -> out, contextMesh, analysisMesh, testPts, testVec, port, radiationResult, radiationMesh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; plug-in component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
panel_4 = Panel(series)
panel_5 = Panel(radiationanalysis.totalRadiation)
sort_list = SortList(Keys=radiationanalysis.totalRadiation, ValuesValuesA=series)  # -> Keys, ValuesValuesA
list_item = ListItem(List=sort_list.ValuesValuesA, Index=0, Wrap=True)
unit_z = UnitZ(Factor=1)
panel_6 = Panel(list_item)
rotate_3d = Rotate3D(Geometry=brep, Angle=list_item, Center=point, Axis=unit_z)  # -> Geometry, Transform
