# Grasshopper definition sunpath.gh (Grasshopper 1.0.7)
# plug-ins: LadybugGrasshopper

panel = Panel("http://climate.onebuilding.org/WMO_Region_3_South_America/BRA_Brazil/BA_Bahia/BRA_BA_Salvador-Magalhaes.Intl.AP.832480_TMYx.zip")
lb_falsestarttoggle = LBFalseStartToggle(False)
epwmap = LBEPWmap(epw_map=lb_falsestarttoggle)  # -> Output; plug-in component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
downloadepw = LBDownloadWeather(weather_URL=panel)  # -> epw_file, stat_file, ddy_file; plug-in component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
importepw = LBImportEPW(epw_file=downloadepw.epw_file)  # -> location, dry_bulb_temperature, dew_point_temperature, relative_humidity, wind_speed, wind_direction, direct_normal_rad, diffuse_horizontal_rad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; plug-in component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
analysisperiod = LBAnalysisPeriod(start_month=1, start_day=1, start_hour=0)  # -> period, hoys, dates; plug-in component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
legendpar = LBLegendParameters()  # -> leg_par; plug-in component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
sunpath = LBSunPath(
    location=importepw.location,
    hoys=analysisperiod.hoys,
    scale=1,
    data=importepw.dry_bulb_temperature,
    legend_par=legendpar)  # -> out, vectors, altitudes, azimuths, hoys, sun_pts, analemma, daily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; plug-in component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
