# Grasshopper definition teste archicad connect.gh (Grasshopper 1.0.7)
# plug-ins: Grasshopper-ARCHICAD Live Connection 2.2

number_slider = Slider(10, range=0..10)
curve = Curve(<curve referenced from the Rhino model>)
composite = Composite(AC_Composite=(2, 0, -1))
series = Series(Start=Slider(0, range=0..1), Step=Slider(6.55, range=0..10), Count=number_slider)
series_2 = Series(Start=Slider(0, range=0..1), Step=Slider(5, range=0..360), Count=number_slider)
unit_z = UnitZ(Factor=series)
wallsetc = WallSettingsComposite(AC_ActiveState_Name="CompositeSlanted")
move = Move(Geometry=curve, Motion=unit_z)  # -> Geometry, Transform
polygon_center = PolygonCenter(Polyline=move.Geometry)  # -> CenterV, CenterE, CenterA
data = Data(polygon_center.CenterA)
rotate_3d = Rotate3D(Geometry=move.Geometry, Angle=degrees(series_2), Center=polygon_center.CenterA, Axis=Vector(0, 0, 1))  # -> Geometry, Transform
wall = Wall(Synchronize=True, Curve=rotate_3d.Geometry, WallSettings=wallsetc)
slabsetc = SlabSettingsComposite(Composite=composite, Composite_2=composite, AC_ActiveState_Name="Composite")
slab = Slab(Synchronize=Toggle(True), Polygon=rotate_3d.Geometry, SlabSettings=slabsetc)
