# Grasshopper definition teste_grevit.gh (Grasshopper 1.0.7)
# plug-ins: Grevit.GrassHopper

number_slider = Slider(10, range=0..20)
series = Series(Start="0.00", Step=Slider(3, range=0.1..10), Count=number_slider)
concatenate = Concatenate(Fragment_A="Pav.", Fragment_B=" ", A=series)
duplicate_data = DuplicateData(Data=Toggle(True), Number=number_slider, Order=True)
plane_surface = PlaneSurface(Plane=PlaneXY(0, 0, 0), XSize=Domain(-10, 10), YSize=Domain(-10, 10))
grevit_revit_level = GrevitRevitLevel(Name=concatenate, Elevation=series, View=duplicate_data)
panel = Panel(concatenate)
grevit_revit_slab = GrevitRevitSlab(Surface=plane_surface, Type="teste", Levelbottom=concatenate)
merge = Merge(Data1=grevit_revit_level, Data2=grevit_revit_slab)
grevit_send = GrevitSend(
    Components=flatten(merge),
    Send=Toggle(False),
    IP="127.0.0.1",
    Port="8002",
    Update=Toggle(False),
    Scale=Slider(1, range=1..1000))
panel_2 = Panel(grevit_send)
